# Grasshopper definition Geodesic_Reuse_v2.gh (Grasshopper 1.0.7)
# plug-ins: GhPolyhedra, MetaHopper, karambaGH

# ----
# TriangleMesh
mesh = Mesh(<mesh referenced from the Rhino model>)

mcomp = Decompose(Mesh=mesh)  # -> Vertices, Faces, Colours, Normals
vertices = FaceVertices(Face=mcomp.Faces)  # -> CornerA, CornerB, CornerC, CornerD
flatten_tree = FlattenTree(Data=mcomp.Vertices, Path="{0}")
flatten_tree_2 = FlattenTree(Data=vertices.CornerA, Path="{0}")
flatten_tree_3 = FlattenTree(Data=vertices.CornerB, Path="{1}")
flatten_tree_4 = FlattenTree(Data=vertices.CornerC, Path="{2}")
merge_multiple = MergeMultiple(Stream0=flatten_tree_2, Stream1=flatten_tree_3, Stream2=flatten_tree_4)
flip_matrix = FlipMatrix(Data=merge_multiple)
list_item = ListItem(List=flatten_tree, Index=flip_matrix, Wrap=False)

# ---- group: Extracting length for known cross section
geometry_pipeline = GeometryPipeline(
    GroupByLayer=False,
    GroupByType=False,
    IncludeHidden=True,
    IncludeLocked=True,
    LayerFilter="wall studs - external",
    NameFilter="*",
    SublayerFiltering=True,
    TypeFilter=1073741848)  # disabled
geometry_pipeline_2 = GeometryPipeline(
    GroupByLayer=False,
    GroupByType=False,
    IncludeHidden=True,
    IncludeLocked=True,
    LayerFilter="*door frames",
    NameFilter="*",
    SublayerFiltering=True,
    TypeFilter=1073741848)  # disabled
geometry_pipeline_3 = GeometryPipeline(
    GroupByLayer=False,
    GroupByType=False,
    IncludeHidden=True,
    IncludeLocked=True,
    LayerFilter="*purlins",
    NameFilter="*",
    SublayerFiltering=True,
    TypeFilter=1073741848)  # disabled
geometry_pipeline_4 = GeometryPipeline(
    GroupByLayer=False,
    GroupByType=False,
    IncludeHidden=True,
    IncludeLocked=True,
    LayerFilter="*roof frame",
    NameFilter="*",
    SublayerFiltering=True,
    TypeFilter=1073741848)  # disabled
geometry_pipeline_5 = GeometryPipeline(
    GroupByLayer=False,
    GroupByType=False,
    IncludeHidden=True,
    IncludeLocked=True,
    LayerFilter="*floor frame",
    NameFilter="*",
    SublayerFiltering=True,
    TypeFilter=1073741848)  # disabled
geometry_pipeline_6 = GeometryPipeline(
    GroupByLayer=False,
    GroupByType=False,
    IncludeHidden=True,
    IncludeLocked=True,
    LayerFilter="*rotated roof inner structure",
    NameFilter="*",
    SublayerFiltering=True,
    TypeFilter=1073741848)
geometry_pipeline_7 = GeometryPipeline(
    GroupByLayer=False,
    GroupByType=False,
    IncludeHidden=True,
    IncludeLocked=True,
    LayerFilter="*floor joists",
    NameFilter="*",
    SublayerFiltering=True,
    TypeFilter=1073741848)
brep = Brep([geometry_pipeline_3, geometry_pipeline_6, geometry_pipeline_5, geometry_pipeline_4, geometry_pipeline, geometry_pipeline_7])  # disabled
graft_tree = GraftTree(Tree=brep, IncludeEmptyLists=True, IncludeNullItems=True)  # disabled
deconstruct_brep = DeconstructBrep(Brep=graft_tree)  # -> Faces, Edges, Vertices; disabled
panel = Panel("0.5,0.5")  # disabled
param_viewer = ParamViewer(graft_tree)  # disabled
evaluate_surface = EvaluateSurface(Surface=reparameterize(deconstruct_brep.Faces), Point=panel)  # -> Point, Normal, UDirection, VDirection, Frame; disabled
unit_z = UnitZ(Factor=1)  # disabled
dot_product = DotProduct(VectorA=unit_z, VectorB=evaluate_surface.Normal, Unitize=False)  # disabled
panel_2 = Panel("0")  # disabled
equality = Equality(FirstNumber=dot_product, SecondNumber=panel_2)  # -> Equality, Inequality; disabled
cull_pattern = CullPattern(List=deconstruct_brep.Faces, CullPattern=equality.Inequality)  # disabled
is_planar = IsPlanar(Surface=cull_pattern, Interior=True)  # -> Planar, Plane; disabled
list_item_2 = ListItem(List=is_planar.Plane, Index=0, Wrap=True)  # disabled
bounding_box = BoundingBox(Content=graft_tree, Plane=list_item_2)  # -> Box, flatten(Box_2); disabled
deconstruct_box = DeconstructBox(Box=bounding_box.Box)  # -> Plane, flatten(X), flatten(Y), flatten(Z); disabled
number = Number(deconstruct_box.Y)  # disabled
number_2 = Number(deconstruct_box.X)  # disabled
number_3 = Number(deconstruct_box.Z)  # disabled

# ---- group: Rotating Geodesic Sphere to 5 Point top
icosphere = IcoSphere(Plane=PlaneXY(0, 0, 0), Scale=Slider(4, range=0..6), Density=Slider(1, range=0..5))  # -> flatten(Mesh)
mesh_edges = MeshEdges(Mesh=icosphere)  # -> NakedEdges, InteriorEdges, NonManifoldEdges
end_points = EndPoints(Curve=mesh_edges.InteriorEdges)  # -> Start, End
point = Point([end_points.Start, end_points.End])
distance = Distance(PointA=point, PointB=graft(point))
equality_2 = Equality(FirstNumber=distance, SecondNumber=0)  # -> Equality, Inequality
cull_pattern_2 = CullPattern(List=mesh_edges.InteriorEdges, CullPattern=equality_2.Equality)
list_length = ListLength(List=cull_pattern_2)  # -> simplify(flatten(Length))
panel_3 = Panel(list_length)
flip_matrix_2 = FlipMatrix(Data=cull_pattern_2)
series = Series(Start=0, Step=1, Count=10)
list_item_3 = ListItem(List=flip_matrix_2, Index=Slider(0, range=0..500), Wrap=False)
member_index = MemberIndex(Set=panel_3, Member="5")  # -> Index, Count
list_item_4 = ListItem(List=member_index.Index, Index=Slider(18, range=0..50), Wrap=True)
list_item_5 = ListItem(List=flip_matrix_2, Index=list_item_4, Wrap=True)  # -> flatten(Item)
null_item = NullItem(Item=list_item_5)  # -> NullFlags, InvalidFlags, Description
gate_not = GateNot(A=null_item.NullFlags)
cull_pattern_3 = CullPattern(List=list_item_5, CullPattern=gate_not)
end_points_2 = EndPoints(Curve=cull_pattern_3)  # -> Start, End
panel_4 = Panel(cull_pattern_3)
point_2 = Point([end_points_2.Start, end_points_2.End])
remove_duplicate_points_karamba3d = RemoveDuplicatePointsKaramba3D(Point=point_2, LimitDistance=0.005)  # -> OutPoint, Info, Indexes
list_item_6 = ListItem(List=remove_duplicate_points_karamba3d.Indexes, Index=0, Wrap=True)
list_item_7 = ListItem(List=point_2, Index=list_item_6, Wrap=True)
distance_2 = Distance(PointA=remove_duplicate_points_karamba3d.OutPoint, PointB=list_item_7)
equality_3 = Equality(FirstNumber=distance_2, SecondNumber=0)  # -> Equality, Inequality
xy_plane = XYPlane(Origin=Point(0, 0, 0))
yz_plane = YZPlane(Origin=Point(0, 0, 0))
cull_pattern_4 = CullPattern(List=remove_duplicate_points_karamba3d.OutPoint, CullPattern=equality_3.Inequality)
plane_fit = PlaneFit(Points=cull_pattern_4)  # -> Plane, Deviation
orient = Orient(Geometry=icosphere, Source=plane_fit.Plane, Target=xy_plane)  # -> Geometry, Transform
volume = Volume(Geometry=orient.Geometry)  # -> Volume, Centroid
construct_point = ConstructPoint(XCoordinate=0, YCoordinate=0, ZCoordinate=0)
line = Line(StartPoint=volume.Centroid, EndPoint=construct_point)
length = Length(Curve=line)
multiplication = Multiplication(A="-1", B=length)
unit_z_2 = UnitZ(Factor=multiplication)
move = Move(Geometry=orient.Geometry, Motion=unit_z_2)  # -> Geometry, Transform
volume_2 = Volume(Geometry=move.Geometry)  # -> Volume, Centroid

# ----
panel_5 = Panel("EdgePolyCrv")
polyline = PolyLine(Vertices=list_item, Closed=True)
explode = Explode(Curve=polyline, Recursive=True)  # -> Segments, Vertices
list_item_8 = ListItem(List=explode.Segments, Index=Slider(0, range=0..3), Wrap=False)
list_item_9 = ListItem(List=explode.Segments, Index=Slider(1, range=0..3), Wrap=False)
list_item_10 = ListItem(List=explode.Segments, Index=Slider(2, range=0..3), Wrap=False)
edge_surface = EdgeSurface(CurveA=list_item_8, CurveB=list_item_9, CurveC=list_item_10)
brep_2 = Brep(cull_pattern)  # disabled
internalized_foundation = Brep([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])
brep_3 = Brep(geometry_pipeline_6)
brep_4 = Brep([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])
panel_6 = Panel("PolySrf")
brep_join = BrepJoin(Breps=flatten(edge_surface))  # -> Breps, Closed
merge = Merge(Data1=internalized_foundation, Data2=brep_4)

# ---- group: Sorting unknown dimensions
geometry_pipeline_8 = GeometryPipeline(
    GroupByLayer=False,
    GroupByType=False,
    IncludeHidden=True,
    IncludeLocked=True,
    LayerFilter="*foundation frame",
    NameFilter="*",
    SublayerFiltering=True,
    TypeFilter=1073741848)
bounding_box_2 = BoundingBox(Content=merge, Plane=PlaneXY(0, 0, 0))  # -> Box, Box_2
deconstruct_box_2 = DeconstructBox(Box=bounding_box_2.Box_2)  # -> Plane, X, Y, Z
number_4 = Number(graft(deconstruct_box_2.Y))
number_5 = Number(graft(deconstruct_box_2.X))
number_6 = Number(deconstruct_box_2.Z)
panel_7 = Panel(number_5)
panel_8 = Panel(number_6)
panel_9 = Panel(number_4)
larger_than = LargerThan(FirstNumber=panel_7, SecondNumber=panel_9)  # -> LargerThan, OrEqualTo
pick_n_choose = PickNChoose(Pattern=larger_than.LargerThan, Stream0=panel_7, Stream1=panel_9)  # -> flatten(Result)
pick_n_choose_2 = PickNChoose(Pattern=larger_than.LargerThan, Stream0=panel_9, Stream1=panel_7)  # -> flatten(Result)
panel_10 = Panel(pick_n_choose_2)
panel_11 = Panel(pick_n_choose)
domain_box = DomainBox(Base=PlaneXY(0, 0, 0), X=panel_11, Y=panel_10, Z=panel_8)
deconstruct_box_3 = DeconstructBox(Box=domain_box)  # -> Plane, X, Y, Z
number_7 = Number(deconstruct_box_3.Y)
number_8 = Number(deconstruct_box_3.Z)
number_9 = Number(deconstruct_box_3.X)
panel_12 = Panel(number_7)
panel_13 = Panel(number_9)
panel_14 = Panel(number_8)

# ----
number_10 = Number(graft(number))  # disabled
number_11 = Number(graft(number_2))  # disabled
number_12 = Number(number_3)  # disabled
panel_15 = Panel(number_12)  # disabled
panel_16 = Panel(number_10)  # disabled
panel_17 = Panel(number_11)  # disabled
larger_than_2 = LargerThan(FirstNumber=panel_17, SecondNumber=panel_16)  # -> LargerThan, OrEqualTo; disabled
pick_n_choose_3 = PickNChoose(Pattern=larger_than_2.LargerThan, Stream0=panel_17, Stream1=panel_16)  # -> flatten(Result); disabled
pick_n_choose_4 = PickNChoose(Pattern=larger_than_2.LargerThan, Stream0=panel_16, Stream1=panel_17)  # -> flatten(Result); disabled
panel_18 = Panel(pick_n_choose_4)  # disabled
panel_19 = Panel(pick_n_choose_3)  # disabled
domain_box_2 = DomainBox(Base=PlaneXY(0, 0, 0), X=panel_19, Y=panel_18, Z=panel_15)  # disabled
deconstruct_box_4 = DeconstructBox(Box=domain_box_2)  # -> Plane, X, Y, Z; disabled
number_13 = Number(deconstruct_box_4.Y)  # disabled
number_14 = Number(deconstruct_box_4.Z)  # disabled
number_15 = Number(deconstruct_box_4.X)  # disabled
panel_20 = Panel(number_13)  # disabled
panel_21 = Panel(number_15)  # disabled
panel_22 = Panel(number_14)  # disabled
unit_x = UnitX(Factor=Slider(10, range=0..10))
panel_23 = Panel(move.Geometry)
construct_point_2 = ConstructPoint(XCoordinate=Slider(25.44, range=0..100), YCoordinate=Slider(25.44, range=0..100), ZCoordinate=0)
move_2 = Move(Geometry=move.Geometry, Motion=construct_point_2)  # -> Geometry, Transform
move_3 = Move(Geometry=move_2.Geometry, Motion=unit_x)  # -> Geometry, Transform; disabled
relay = Relay([move_2.Geometry, move_3.Geometry])

# ----
# Geodesic Dome
face_boundaries = FaceBoundaries(Mesh=relay)
boundary_surfaces = BoundarySurfaces(Edges=face_boundaries)
brep_join_2 = BrepJoin(Breps=boundary_surfaces)  # -> Breps, Closed
box = Box(brep_join_2.Breps)
deconstruct_brep_2 = DeconstructBrep(Brep=box)  # -> Faces, Edges, Vertices
list_item_11 = ListItem(List=reverse(deconstruct_brep_2.Edges), Index=0, Wrap=True)
list_item_12 = ListItem(List=reverse(deconstruct_brep_2.Faces), Index=0, Wrap=True)
length_2 = Length(Curve=list_item_11)
division = Division(A=length_2, B=2)
unit_z_3 = UnitZ(Factor=division)
negative = Negative(Value=unit_z_3)
move_4 = Move(Geometry=list_item_12, Motion=negative)  # -> Geometry, Transform
split_brep = SplitBrep(Brep=brep_join_2.Breps, Cutter=move_4.Geometry)
list_item_13 = ListItem(List=split_brep, Index=0, Wrap=True)
mesh_brep = MeshBrep(
    Brep=list_item_13,
    Settings={GridMaxCount=0, GridMinCount=16, JaggedSeams=False, MaxEdgeLength=0, MinEdgeLength=0.0001, MinTolerance=0, Refine=True, RefineAngle=0, RelativeTolerance=0.65, SimplePlanes=True, Tolerance=0})
mesh_edges_2 = MeshEdges(Mesh=mesh_brep)  # -> NakedEdges, InteriorEdges, NonManifoldEdges
curve = Curve([mesh_edges_2.InteriorEdges, mesh_edges_2.NakedEdges])
length_3 = Length(Curve=curve)

panel_24 = Panel("40")  # disabled
unit_y = UnitY(Factor=panel_24)  # disabled
num_of_domes = Slider(2, range=0..10)
unit_x_2 = UnitX(Factor=Slider(10, range=0..10))
colour = Colour(RGB(0, 0, 0))

number_slider = Slider(100, range=0..100)
multiplication_2 = Multiplication(A=length_3, B=number_slider)
integer = Integer(multiplication_2)
division_2 = Division(A=integer, B=number_slider)
create_set = CreateSet(List=division_2)  # -> Set, Map
member_index_2 = MemberIndex(Set=division_2, Member=create_set.Set)  # -> Index, Count
panel_25 = Panel(create_set.Set)
panel_26 = Panel(member_index_2.Count)

bounds = Bounds(Numbers=length_3)
deconstruct_domain = DeconstructDomain(Domain=bounds)  # -> Start, End
gradient = Gradient(
    LowerLimit=deconstruct_domain.Start,
    UpperLimit=deconstruct_domain.End,
    Parameter=length_3,
    stops=[0: RGB(234, 38, 0), 0.25: RGB(234, 126, 0), 0.5: RGB(254, 244, 84), 0.75: RGB(173, 203, 249), 1: RGB(75, 107, 169)])
pipe = Pipe(Curve=curve, Radius=Slider(0.1, range=0.1..0.5), Caps=0)  # -> flatten(Pipe)
custom_preview = CustomPreview(Geometry=pipe, Material=gradient)

linear_array = LinearArray(Geometry=mesh_edges_2.InteriorEdges, Direction=unit_x_2, Count=num_of_domes)  # -> Geometry, Transform
curve_2 = Curve(flatten(linear_array.Geometry))

# ---- group: design curves
curve_3 = Curve(curve_2)

# ---- group: Lengths in design
length_4 = Length(Curve=curve_3)

# ----
custom_preview_2 = CustomPreview(Geometry=curve_3, Material=colour)

curve_middle = CurveMiddle(Curve=curve)
text_tag = TextTag(Location=curve_middle, Text=division_2, Colour=ColourSwatch(SwatchColor=RGB(0, 0, 0)))

# ---- group: width - x
number_16 = Number([panel_21, panel_13])

# ---- group: height - y
number_17 = Number([panel_22, panel_14])

# ----
construct_point_3 = ConstructPoint(XCoordinate="0.2", YCoordinate="0.05", ZCoordinate=length_4)
value_list = ValueList({"CRITICAL", "ERROR", "WARNING", "INFO", "DEBUG", "NOTSET"}, selected="DEBUG")

# ---- group: design
point_3 = Point(construct_point_3)

# ----
rhino_doc_dir = RhinoDocDir()  # -> rhino_doc_dir
# ---------- rhino_doc_dir: Python ----------
import scriptcontext as sc
from os import path

rhino_doc_dir = path.abspath(path.dirname(sc.doc.Path))
# ---------- end rhino_doc_dir ----------
deconstruct = Deconstruct(Point=point_3)  # -> XComponent, YComponent, ZComponent
concatenate = Concatenate(FragmentA=rhino_doc_dir, FragmentB="\jl_scripts\lp_assignment.jl")
number_18 = Number("1e6")
boolean_toggle = BooleanToggle(True)
boolean = Boolean(boolean_toggle)
stream_filter = StreamFilter(Gate=boolean, Stream0=deconstruct.ZComponent, Stream1="0")
construct_point_4 = ConstructPoint(XCoordinate=deconstruct.XComponent, YCoordinate=deconstruct.YComponent, ZCoordinate=stream_filter)

# ---- group: design curves
curve_4 = Curve(curve_3)

# ---- group: design
curve_5 = Curve(curve_4)

# ----
length_5 = Length(Curve=curve_5)
use_milp = BooleanToggle(False)
boolean_2 = Boolean(use_milp)
gate_not_2 = GateNot(A=use_milp)
S = Shader([{diffuse=RGB(11, 125, 222), emission=RGB(3, 38, 67), shine=0.5, specular=RGB(255, 255, 255), transparency=0}, {diffuse=RGB(222, 37, 11), emission=RGB(67, 11, 3), shine=0.5, specular=RGB(255, 255, 255), transparency=0}, {diffuse=RGB(71, 222, 11), emission=RGB(21, 67, 3), shine=0.5, specular=RGB(255, 255, 255), transparency=0}, {diffuse=RGB(222, 194, 11), emission=RGB(67, 58, 3), shine=0.5, specular=RGB(255, 255, 255), transparency=0}])
curve_6 = Curve(simplify(graft(curve_4)))

colour_swatch = ColourSwatch(SwatchColor=RGB(238, 203, 142))
colour_swatch_2 = ColourSwatch(SwatchColor=RGB(90, 169, 172))
panel_27 = Panel(""".5
.1""")

control_wire_display = ControlWireDisplay(WireDisplay=Slider(1, range=0..2))

list_length_2 = ListLength(List=panel_20)  # disabled
panel_28 = Panel(list_length_2)  # disabled
number_slider_2 = Slider(1, range=0..1)  # disabled
unit_z_4 = UnitZ(Factor=1)  # disabled
construct_point_5 = ConstructPoint(XCoordinate=0, YCoordinate=0, ZCoordinate=0)  # disabled
series_2 = Series(Start=0, Step=number_slider_2, Count=panel_28)  # disabled
unit_x_3 = UnitX(Factor=series_2)  # disabled
line_sdl = LineSDL(Start=construct_point_5, Direction=unit_z_4, Length=panel_20)  # disabled
unit_x_4 = UnitX(Factor=panel_21)  # disabled
unit_y_2 = UnitY(Factor=panel_22)  # disabled

sort_list = SortList(Keys=panel_20, ValuesValuesA=line_sdl)  # -> Keys, ValuesValuesA; disabled
line_2 = Line(sort_list.ValuesValuesA)  # disabled

list_length_3 = ListLength(List=panel_12)
panel_29 = Panel(list_length_3)
unit_z_5 = UnitZ(Factor=1)
construct_point_6 = ConstructPoint(XCoordinate=0, YCoordinate=0, ZCoordinate=0)
series_3 = Series(Start=0, Step=Slider(1, range=0..1), Count=panel_29)
unit_x_5 = UnitX(Factor=series_3)
line_sdl_2 = LineSDL(Start=construct_point_6, Direction=unit_z_5, Length=panel_12)
unit_x_6 = UnitX(Factor=panel_13)
unit_y_3 = UnitY(Factor=panel_14)

sort_list_2 = SortList(Keys=panel_12, ValuesValuesA=line_sdl_2)  # -> Keys, ValuesValuesA
line_3 = Line(sort_list_2.ValuesValuesA)

move_5 = Move(Geometry=sort_list_2.ValuesValuesA, Motion=unit_x_5)  # -> Geometry, Transform
extrude = Extrude(Base=move_5.Geometry, Direction=unit_x_6)
extrude_2 = Extrude(Base=extrude, Direction=unit_y_3)

length_6 = Length(Curve=move_5.Geometry)
custom_preview_3 = CustomPreview(Geometry=extrude_2, Shader=ColourSwatch(SwatchColor=RGBA(255, 245, 255, 0)))

# ---- group: inventory geometries
geometry = Geometry(extrude_2)

# ----
geometry_2 = Geometry(simplify(graft(geometry)))

move_6 = Move(Geometry=sort_list.ValuesValuesA, Motion=unit_x_3)  # -> Geometry, Transform; disabled

move_7 = Move(Geometry=move_6.Geometry, Motion=unit_y)  # -> Geometry, Transform; disabled

extrude_3 = Extrude(Base=move_7.Geometry, Direction=unit_x_4)  # disabled
extrude_4 = Extrude(Base=extrude_3, Direction=unit_y_2)  # disabled

# ---- group: inventory curves
curve_7 = Curve([move_7.Geometry, move_5.Geometry])

# ---- group: Lengths in inventory
length_7 = Length(Curve=curve_7)

# ----
construct_point_7 = ConstructPoint(XCoordinate=number_16, YCoordinate=number_17, ZCoordinate=length_7)

# ---- group: inventory
point_4 = Point(construct_point_7)

# ----
deconstruct_2 = Deconstruct(Point=point_4)  # -> XComponent, YComponent, ZComponent
stream_filter_2 = StreamFilter(Gate=boolean, Stream0=deconstruct_2.ZComponent, Stream1="0")
construct_point_8 = ConstructPoint(XCoordinate=deconstruct_2.XComponent, YCoordinate=deconstruct_2.YComponent, ZCoordinate=stream_filter_2)
cross_reference = CrossReference(ListListA=simplify(graft(construct_point_4)), ListListB=construct_point_8, CrossMode=1)  # -> simplify(ListListA), simplify(ListListB)
deconstruct_3 = Deconstruct(Point=cross_reference.ListListB)  # -> XComponent, YComponent, ZComponent
deconstruct_4 = Deconstruct(Point=cross_reference.ListListA)  # -> XComponent, YComponent, ZComponent
longest_list = LongestList(ListListA=number_18, ListListB=deconstruct_2.ZComponent, PaddingMode=2)  # -> ListListA, ListListB
smaller_than = SmallerThan(FirstNumber=deconstruct_4.ZComponent, SecondNumber=deconstruct_3.ZComponent)  # -> SmallerThan, OrEqualTo
distance_3 = Distance(PointA=cross_reference.ListListA, PointB=cross_reference.ListListB)
boolean_3 = Boolean(smaller_than.SmallerThan)

# ---- group: inventory curves
curve_8 = Curve(curve_7)

# ---- group: inventory
curve_9 = Curve(curve_8)

# ----
curve_10 = Curve(simplify(graft(curve_9)))

# ---- group: Supports
deconstruct_plane = DeconstructPlane(Plane=move_4.Geometry)  # -> Origin, XAxis, YAxis, ZAxis
curve_curve = CurveCurve(CurveA=curve, CurveB=curve)  # -> flatten(Points), ParamsA, ParamsB
cull_duplicates = CullDuplicates(Points=curve_curve.Points, Tolerance=0.1, CullMode=3)  # -> Points, Indices, Valence
point_5 = Point(cull_duplicates.Points)
deconstruct_5 = Deconstruct(Point=point_5)  # -> XComponent, YComponent, ZComponent
number_slider_3 = Slider(0.646, range=0..100)
smaller_than_2 = SmallerThan(FirstNumber=deconstruct_5.ZComponent, SecondNumber=number_slider_3)  # -> SmallerThan, OrEqualTo
larger_than_3 = LargerThan(FirstNumber=deconstruct_5.ZComponent, SecondNumber=number_slider_3)  # -> LargerThan, OrEqualTo
cull_pattern_5 = CullPattern(List=cull_duplicates.Points, CullPattern=smaller_than_2.SmallerThan)
cull_pattern_6 = CullPattern(List=cull_duplicates.Points, CullPattern=larger_than_3.LargerThan)

# ----
point_6 = Point(cull_pattern_6)
volume_3 = Volume(Geometry=relay)  # -> Volume, Centroid
line_4 = Line(StartPoint=volume_3.Centroid, EndPoint=point_6)
vector = Vector(simplify(line_4))
vector_2 = Vector(expr("0.02*x", vector))
circle_cnr = CircleCNR(Center=point_6, Normal=vector, Radius=Slider(0.1, range=0..1))
extrude_5 = Extrude(Base=circle_cnr, Direction=vector_2)
vector_display = VectorDisplay(Anchor=point_6, Vector=vector_2)
cap_holes = CapHoles(Brep=extrude_5)

# ---- group: Supports / Points in
point_7 = Point(cull_pattern_5)

# ---- group: Supports (continued)
sphere = Sphere(Base=point_7, Radius=Slider(0.1, range=0..1))

# ---- group: Supports / Points out
point_8 = Point(cull_pattern_6)

# ---- group: Import remote python modules
ghpython_script = PythonScript()  # -> rhino_doc_dir; same code as rhino_doc_dir
panel_30 = Panel(ghpython_script)
panel_31 = Panel("""numpy
numpy.linalg
julia""")
ghpythonremote = GHPythonRemote(location="conda://py27", run=Toggle(True), modules=panel_31, log_level=value_list, working_dir=panel_30)  # -> out, linked_modules, rpy; inputs run: Boolean, modules: list
# ---------- ghpythonremote: Python ----------
import sys
import scriptcontext
import logging
import inspect
import ghpythonremote
from ghpythonremote.connectors import GrasshopperToPythonRemote
from os import path
from time import sleep

local_log_level = getattr(logging, log_level, logging.WARNING)
logger = logging.getLogger('ghpythonremote')
logger.setLevel(local_log_level)
ch = logging.StreamHandler()
ch.setLevel(local_log_level)
formatter = logging.Formatter('%(levelname)s: %(name)s:\n%(message)s')
ch.setFormatter(formatter)
logger.handlers = []
logger.addHandler(ch)
logger = logging.getLogger('ghpythonremote.GH_to_python')

ROOT = path.abspath(path.dirname(inspect.getfile(ghpythonremote)))
rpyc_server_py = path.join(ROOT, 'pythonservice.py')

# Set connection to CLOSED if this is the first run
# and initialize set of linked modules
try:
    remote_python_status
except NameError:
    remote_python_status = 'CLOSED'
    lkd_modules = set()

# Wait for connection to connect or terminate
timer = 0
while remote_python_status == 'CONNECTING' or remote_python_status == 'CLOSING':
    sleep(1)
    timer += 1
    if timer == 10:
        try:
            gh2py_manager.__exit__(*sys.exc_info())
        except Exception:
            pass
        remote_python_status = 'CLOSED'
        lkd_modules = set()
        raise RuntimeError("Connection left in an inconsistent state and not returning. Reset everything.")

if run:
    if not remote_python_status == 'OPEN':
        remote_python_status = 'CONNECTING'
        gh2py_manager = GrasshopperToPythonRemote(rpyc_server_py, location=location, timeout=10,
                                                  port=None, log_level=log_level, working_dir=working_dir)
        gh2py = gh2py_manager.__enter__()
        remote_python_status = 'OPEN'

    # Stuff that we can reach
    rpymod = gh2py.py_remote_modules  # A getter function for a named python module
    rpy = gh2py.connection  # Represents the remote instance root object
    scriptcontext.sticky['rpy'] = rpy
    # Add modules
    for mod in modules:
        try:
            scriptcontext.sticky[mod] = rpymod(mod)
            lkd_modules.add(mod)
        except ImportError:
            gh2py_manager.__exit__(*sys.exc_info())
            raise

elif not remote_python_status == 'CLOSED':
    remote_python_status = 'CLOSING'
    # Remove linked modules
    for mod in lkd_modules:
        del scriptcontext.sticky[mod]
    del scriptcontext.sticky['rpy']
    gh2py_manager.__exit__(*sys.exc_info())
    lkd_modules = set()
    remote_python_status = 'CLOSED'

# Change variable name because ghpython resets outputs to None before each run
linked_modules = lkd_modules

logger.info('GH to python connection is {}'.format(remote_python_status))
# ---------- end ghpythonremote ----------
panel_32 = Panel(ghpythonremote.out)

# ----
ghpython_script_2 = PythonScript(module_names=ghpythonremote.linked_modules)  # -> import_statements; inputs module_names: list
# ---------- ghpython_script_2: Python ----------
import_statements = ["import scriptcontext as sc"]
for module_name in module_names:
    import_statements.append("{0} = sc.sticky['{0}']".format(module_name))

if len(module_names) == 0:
    import_statements = []
# ---------- end ghpython_script_2 ----------

# ---- group: Import remote python modules (continued)
panel_33 = Panel(ghpython_script_2)

# ---- group: Matching setup
cross_reference_2 = CrossReference(ListListA=simplify(graft(construct_point_3)), ListListB=construct_point_7, CrossMode=1)  # -> simplify(ListListA), simplify(ListListB)
deconstruct_6 = Deconstruct(Point=cross_reference_2.ListListB)  # -> XComponent, YComponent, ZComponent
deconstruct_7 = Deconstruct(Point=cross_reference_2.ListListA)  # -> XComponent, YComponent, ZComponent
# comparing list A and B and notifying each time the first number is smaller than the second number
smaller_than_3 = SmallerThan(FirstNumber=deconstruct_7.ZComponent, SecondNumber=deconstruct_6.ZComponent)  # -> SmallerThan, OrEqualTo
panel_34 = Panel("1e6")
distance_4 = Distance(PointA=cross_reference_2.ListListA, PointB=cross_reference_2.ListListB)

# ----
boolean_4 = Boolean(smaller_than_3.SmallerThan)

# ---- group: Matching setup (continued)
expression = Expression(okay=boolean_4, big=panel_34, dist=distance_4, Expression="if(okay, dist, big)")
number_19 = Number(simplify(expression))

# ----
expression_2 = Expression(okay=boolean_3, big=panel_34, dist=distance_3, Expression="if(okay, dist, big)")
number_20 = Number(simplify(expression_2))
python_script = PythonScript(
    compute=boolean_2,
    reload=Button(),
    jl_script_path=concatenate,
    costs=number_20,
    design_lengths=deconstruct.ZComponent,
    cutoff_costs=longest_list.ListListA,
    inventory_lengths=deconstruct_2.ZComponent,
    allow_cutoff=boolean_toggle,
    minimize_cutoff=Toggle(True))  # -> out, simplify(graft(assignment)), cost, cutoff_indicators; inputs reload: Boolean, costs: tree, design_lengths: list, cutoff_costs: list, inventory_lengths: list, allow_cutoff: Boolean, minimize_cutoff: Boolean
# ---------- python_script: Python ----------
import Rhino.Geometry as rg
import Rhino.Collections.Point3dList as Point3dList
import rhinoscriptsyntax as rs
from ghpythonlib.treehelpers import tree_to_list, list_to_tree

import scriptcontext as sc
import ghpythonremote
from time import time
np = sc.sticky['numpy']
rpy = sc.sticky['rpy']
jl = sc.sticky['julia']

## Fast way of sending data for numpy array creation
#remote_range = ghpythonremote.deliver(rpy, range(1000))
#array = np.array(remote_range)
## This is much slower
##b = np.array(range(1000))
#
## Get the array back as a local IronPython list
#list = ghpythonremote.obtain(array.tolist())

# send the data to the remote interpreter, and then create the arrays from this remote object

st_time = time()
_costs = tree_to_list(costs, [])
cost_m = ghpythonremote.deliver(rpy, _costs)
design_len_v = ghpythonremote.deliver(rpy, design_lengths)
inventory_len_v = ghpythonremote.deliver(rpy, inventory_lengths)
cutoff_costs_v = ghpythonremote.deliver(rpy, cutoff_costs)

total_time = time() - st_time
print('cost matrix ghpyremote sending takes {} ms'.format(total_time*1e3))

st_time = time()
try:
    jl.Main.eval('println("Julia env inititated.")')
except:
    jl.Julia()

try:
    jl.Main.eval('using Main:solve_upcycling_assignment')
    if reload:
        raise RuntimeError()
except:
    jl.Main.eval('using Revise')
    jl.Main.include(jl_script_path)

total_time = time() - st_time
print('Julia setup takes {} ms'.format(total_time*1e3))

#https://github.com/Gnimuc/Hungarian.jl
if compute:
    st_time = time()
    _assignment, (_x_opt, _y_opt), _cost_opt = \
        jl.Main.solve_upcycling_assignment(design_len_v, inventory_len_v, cost_m, cutoff_costs_v, 
            allow_cutoff=allow_cutoff, minimize_cutoff=minimize_cutoff)
    assert np.all(_assignment>0), 'Assignment has zero indices (which should all >= 1).'
    # Julia is 1-indexed
    _assignment -= 1
    total_time = time() - st_time
    print('Julia computation used {:.3f} ms'.format(total_time * 1e3))
    
    st_time = time()
    assignment = ghpythonremote.obtain(_assignment.tolist())
    y_opt = ghpythonremote.obtain(_y_opt.tolist())
    cutoff_indicators = [bool(v) for v in y_opt]
    assignment = [int(v) for v in assignment]
    cost = _cost_opt
    total_time = time() - st_time
    print('Cost {}'.format(cost))
    print('Getting results back to GH takes {} ms'.format(total_time*1e3))
# ---------- end python_script ----------
milp_result = Panel(python_script.cost)
panel_35 = Panel(python_script.out)
panel_36 = Panel(python_script.assignment)
number_21 = Number(number_19)
number_22 = Number(panel_34)
integer_2 = Integer(python_script.assignment)

# ---- group: baked-in HungarianAlgorithm
c_script = CSharpScript(distance_matrix=number_19, integral_scale="1e3", penalty=number_22)  # -> out, matched_A2B_ids, cost_star; inputs distance_matrix: tree of Double, integral_scale: Double, penalty: Double; disabled
# ---------- c_script: C# usings ----------
using System.IO;
using System.Linq;
using System.Data;
using System.Drawing;
using System.Reflection;
using System.Windows.Forms;
using System.Xml;
using System.Xml.Linq;
using System.Runtime.InteropServices;

using Rhino.DocObjects;
using Rhino.Collections;
using GH_IO;
using GH_IO.Serialization;
# ---------- c_script: C# ----------
    // dimension of the input lists
    int n = distance_matrix.BranchCount;
    int m = distance_matrix.Branch(0).Count;

    if(0 == m * n)
    {
      this.Component.AddRuntimeMessage(Grasshopper.Kernel.GH_RuntimeMessageLevel.Error, "intput tree data branch dimension = 0!");
      return;
    }

    if(n > m)
    {
      this.Component.AddRuntimeMessage(Grasshopper.Kernel.GH_RuntimeMessageLevel.Error,
        "Branch count must be smaller than the size of each branch! (design pt number should be smaller than inventory pts!)");
      return;
    }
    // The algorithm doesn't always produce the most optimal result, when the input contains more columns (m) than rows (n).
    // To overcome this issue, square the dimensions of the input before passing it to the algorithm.

    //    var watch = new System.Diagnostics.Stopwatch();
    //    if(timing)
    //    {
    //      watch.Start();
    //    }

    // generate the cost matrix
    int[,] costs = new int[m, m];

    for(int i = 0; i < m; i++)
    {
      for(int j = 0; j < m; j++)
      {
        if(i >= n)
        {
          // fill the matrix to be square
          costs[i, j] = (int) Int32.MaxValue;
        }
        else
        {
          // the algorithm only takes integral inputs, scale it up here.
          double scaled_cost = distance_matrix.Branch(i)[j] * integral_scale;
          if(scaled_cost > Int32.MaxValue) {
            throw new OverflowException(
              //            this.Component.AddRuntimeMessage(Grasshopper.Kernel.GH_RuntimeMessageLevel.Error,
              String.Format("Cost at ({0},{1}): {2} bigger than maximal integral value {3}", i, j, scaled_cost, Int32.MaxValue));
          }
          costs[i, j] = (int) scaled_cost;
        }
      }
    }

    int[,] costs_copy = (int[,]) costs.Clone();

    double final_cost = 0;
    int[] matched_pts2_ids = HungarianAlgorithm.FindAssignments(costs);

    DataTree<int> matched_A2B = new DataTree<int>();
    for(int i = 0; i < n; i++)
    {
      var pth = new GH_Path(i);
      final_cost += (double) costs_copy[i, matched_pts2_ids[i]] / integral_scale;
      matched_A2B.Add(matched_pts2_ids[i], pth);
    }

    if(final_cost > penalty)
    {
      this.Component.AddRuntimeMessage(Grasshopper.Kernel.GH_RuntimeMessageLevel.Error,
        "Computed assignment cost > penalty terms!");
      throw new Exception("Infeasible matching.");
    }

    //    if(timing)
    //    {
    //      watch.Stop();
    //      Print(String.Format("Execution Time: {0} ms", watch.ElapsedMilliseconds));
    //    }

    matched_A2B_ids = matched_A2B;
    cost_star = final_cost;
# ---------- c_script: C# additional code ----------
  /// <summary>
  /// Hungarian Algorithm.
  /// </summary>
  public static class HungarianAlgorithm
  {
    /// <summary>
    /// Finds the optimal assignments for a given matrix of agents and costed tasks such that the total cost is minimized.
    /// </summary>
    /// <param name="costs">A cost matrix; the element at row <em>i</em> and column <em>j</em> represents the cost of agent <em>i</em> performing task <em>j</em>.</param>
    /// <returns>A matrix of assignments; the value of element <em>i</em> is the column of the task assigned to agent <em>i</em>.</returns>
    /// <exception cref="ArgumentNullException"><paramref name="costs"/> is null.</exception>
    public static int[] FindAssignments(int[,] costs)
    {
      if (costs == null)
        throw new ArgumentNullException("costs null!");

      var h = costs.GetLength(0);
      var w = costs.GetLength(1);

      for (var i = 0; i < h; i++)
      {
        var min = int.MaxValue;

        for (var j = 0; j < w; j++)
        {
          min = Math.Min(min, costs[i, j]);
        }

        for (var j = 0; j < w; j++)
        {
          costs[i, j] -= min;
        }
      }

      var masks = new byte[h, w];
      var rowsCovered = new bool[h];
      var colsCovered = new bool[w];

      for (var i = 0; i < h; i++)
      {
        for (var j = 0; j < w; j++)
        {
          if (costs[i, j] == 0 && !rowsCovered[i] && !colsCovered[j])
          {
            masks[i, j] = 1;
            rowsCovered[i] = true;
            colsCovered[j] = true;
          }
        }
      }

      ClearCovers(rowsCovered, colsCovered, w, h);

      var path = new Location[w * h];
      var pathStart = default(Location);
      var step = 1;

      while (step != -1)
      {
        switch (step)
        {
          case 1:
            step = HungarianAlgorithm.RunStep1(masks, colsCovered, w, h);
            break;

          case 2:
            step = HungarianAlgorithm.RunStep2(costs, masks, rowsCovered, colsCovered, w, h, ref pathStart);
            break;

          case 3:
            step = HungarianAlgorithm.RunStep3(masks, rowsCovered, colsCovered, w, h, path, pathStart);
            break;

          case 4:
            step = HungarianAlgorithm.RunStep4(costs, rowsCovered, colsCovered, w, h);
            break;
        }
      }

      var agentsTasks = new int[h];

      for (var i = 0; i < h; i++)
      {
        for (var j = 0; j < w; j++)
        {
          if (masks[i, j] == 1)
          {
            agentsTasks[i] = j;
            break;
          }
        }
      }

      return agentsTasks;
    }

    private static int RunStep1(byte[,] masks, bool[] colsCovered, int w, int h)
    {
      if (masks == null)
        throw new ArgumentNullException("null masks!");

      if (colsCovered == null)
        throw new ArgumentNullException("null colsCovered!");

      for (var i = 0; i < h; i++)
      {
        for (var j = 0; j < w; j++)
        {
          if (masks[i, j] == 1)
            colsCovered[j] = true;
        }
      }

      var colsCoveredCount = 0;

      for (var j = 0; j < w; j++)
      {
        if (colsCovered[j])
          colsCoveredCount++;
      }

      if (colsCoveredCount == h)
        return -1;

      return 2;
    }
    private static int RunStep2(int[,] costs, byte[,] masks, bool[] rowsCovered, bool[] colsCovered, int w, int h, ref Location pathStart)
    {
      if (costs == null)
        throw new ArgumentNullException("null costs");

      if (masks == null)
        throw new ArgumentNullException("null masks");

      if (rowsCovered == null)
        throw new ArgumentNullException("null rowsCovered");

      if (colsCovered == null)
        throw new ArgumentNullException("null colsCovered");

      while (true)
      {
        var loc = HungarianAlgorithm.FindZero(costs, rowsCovered, colsCovered, w, h);
        if (loc.row == -1)
          return 4;

        masks[loc.row, loc.column] = 2;

        var starCol = HungarianAlgorithm.FindStarInRow(masks, w, loc.row);
        if (starCol != -1)
        {
          rowsCovered[loc.row] = true;
          colsCovered[starCol] = false;
        }
        else
        {
          pathStart = loc;
          return 3;
        }
      }
    }
    private static int RunStep3(byte[,] masks, bool[] rowsCovered, bool[] colsCovered, int w, int h, Location[] path, Location pathStart)
    {
      if (masks == null)
        throw new ArgumentNullException("null masks");

      if (rowsCovered == null)
        throw new ArgumentNullException("null rowsCovered");

      if (colsCovered == null)
        throw new ArgumentNullException("null colsCovered");

      var pathIndex = 0;
      path[0] = pathStart;

      while (true)
      {
        var row = HungarianAlgorithm.FindStarInColumn(masks, h, path[pathIndex].column);
        if (row == -1)
          break;

        pathIndex++;
        path[pathIndex] = new Location(row, path[pathIndex - 1].column);

        var col = HungarianAlgorithm.FindPrimeInRow(masks, w, path[pathIndex].row);

        pathIndex++;
        path[pathIndex] = new Location(path[pathIndex - 1].row, col);
      }

      HungarianAlgorithm.ConvertPath(masks, path, pathIndex + 1);
      HungarianAlgorithm.ClearCovers(rowsCovered, colsCovered, w, h);
      HungarianAlgorithm.ClearPrimes(masks, w, h);

      return 1;
    }
    private static int RunStep4(int[,] costs, bool[] rowsCovered, bool[] colsCovered, int w, int h)
    {
      if (costs == null)
        throw new ArgumentNullException("null costs");

      if (rowsCovered == null)
        throw new ArgumentNullException("null rowsCovered");

      if (colsCovered == null)
        throw new ArgumentNullException("null colsCovered");

      var minValue = HungarianAlgorithm.FindMinimum(costs, rowsCovered, colsCovered, w, h);

      for (var i = 0; i < h; i++)
      {
        for (var j = 0; j < w; j++)
        {
          if (rowsCovered[i])
            costs[i, j] += minValue;
          if (!colsCovered[j])
            costs[i, j] -= minValue;
        }
      }
      return 2;
    }

    private static int FindMinimum(int[,] costs, bool[] rowsCovered, bool[] colsCovered, int w, int h)
    {
      if (costs == null)
        throw new ArgumentNullException("null costs");

      if (rowsCovered == null)
        throw new ArgumentNullException("null rowsCovered");

      if (colsCovered == null)
        throw new ArgumentNullException("null colsCovered");

      var minValue = int.MaxValue;

      for (var i = 0; i < h; i++)
      {
        for (var j = 0; j < w; j++)
        {
          if (!rowsCovered[i] && !colsCovered[j])
            minValue = Math.Min(minValue, costs[i, j]);
        }
      }

      return minValue;
    }
    private static int FindStarInRow(byte[,] masks, int w, int row)
    {
      if (masks == null)
        throw new ArgumentNullException("null masks");

      for (var j = 0; j < w; j++)
      {
        if (masks[row, j] == 1)
          return j;
      }

      return -1;
    }
    private static int FindStarInColumn(byte[,] masks, int h, int col)
    {
      if (masks == null)
        throw new ArgumentNullException("null masks");

      for (var i = 0; i < h; i++)
      {
        if (masks[i, col] == 1)
          return i;
      }

      return -1;
    }
    private static int FindPrimeInRow(byte[,] masks, int w, int row)
    {
      if (masks == null)
        throw new ArgumentNullException("null masks");

      for (var j = 0; j < w; j++)
      {
        if (masks[row, j] == 2)
          return j;
      }

      return -1;
    }
    private static Location FindZero(int[,] costs, bool[] rowsCovered, bool[] colsCovered, int w, int h)
    {
      if (costs == null)
        throw new ArgumentNullException("null costs");

      if (rowsCovered == null)
        throw new ArgumentNullException("null rowsCovered");

      if (colsCovered == null)
        throw new ArgumentNullException("null colsCovered");

      for (var i = 0; i < h; i++)
      {
        for (var j = 0; j < w; j++)
        {
          if (costs[i, j] == 0 && !rowsCovered[i] && !colsCovered[j])
            return new Location(i, j);
        }
      }

      return new Location(-1, -1);
    }
    private static void ConvertPath(byte[,] masks, Location[] path, int pathLength)
    {
      if (masks == null)
        throw new ArgumentNullException("null masks");

      if (path == null)
        throw new ArgumentNullException("null path");

      for (var i = 0; i < pathLength; i++)
      {
        if (masks[path[i].row, path[i].column] == 1)
        {
          masks[path[i].row, path[i].column] = 0;
        }
        else if (masks[path[i].row, path[i].column] == 2)
        {
          masks[path[i].row, path[i].column] = 1;
        }
      }
    }
    private static void ClearPrimes(byte[,] masks, int w, int h)
    {
      if (masks == null)
        throw new ArgumentNullException("null masks");

      for (var i = 0; i < h; i++)
      {
        for (var j = 0; j < w; j++)
        {
          if (masks[i, j] == 2)
            masks[i, j] = 0;
        }
      }
    }
    private static void ClearCovers(bool[] rowsCovered, bool[] colsCovered, int w, int h)
    {
      if (rowsCovered == null)
        throw new ArgumentNullException("null rowsCovered");

      if (colsCovered == null)
        throw new ArgumentNullException("null colsCovered");

      for (var i = 0; i < h; i++)
      {
        rowsCovered[i] = false;
      }

      for (var j = 0; j < w; j++)
      {
        colsCovered[j] = false;
      }
    }

    private struct Location
    {
      internal readonly int row;
      internal readonly int column;

      internal Location(int row, int col)
      {
        this.row = row;
        this.column = col;
      }
    }
  } // end HungarianAlgorithm class
# ---------- end c_script ----------

# ----
python_script_2 = PythonScript(compute=Toggle(True), costs=number_21, penalty=number_22)  # -> out, simplify(graft(assignment)), cost; inputs costs: tree
# ---------- python_script_2: Python ----------
import Rhino.Geometry as rg
import Rhino.Collections.Point3dList as Point3dList
import rhinoscriptsyntax as rs
from ghpythonlib.treehelpers import tree_to_list, list_to_tree

import scriptcontext as sc
import ghpythonremote
from time import time
np = sc.sticky['numpy']
rpy = sc.sticky['rpy']
jl = sc.sticky['julia']

## Fast way of sending data for numpy array creation
#remote_range = ghpythonremote.deliver(rpy, range(1000))
#array = np.array(remote_range)
## This is much slower
##b = np.array(range(1000))
#
## Get the array back as a local IronPython list
#list = ghpythonremote.obtain(array.tolist())

# send the data to the remote interpreter, and then create the arrays from this remote object

st_time = time()
_costs = tree_to_list(costs, [])
cost_m = ghpythonremote.deliver(rpy, _costs)
total_time = time() - st_time
print('cost matrix ghpyremote sending takes {} ms'.format(total_time*1e3))

st_time = time()
st_time = time()

try:
    jl.Main.eval('println("Julia env inititated.")')
except:
    jl.Julia()
try:
    jl.Main.eval('using Hungarian')
except:
    jl.Main.eval('using Pkg; Pkg.add("Hungarian")')
    jl.Main.eval('using Hungarian')

total_time = time() - st_time
print('Julia setup takes {} ms'.format(total_time*1e3))

#https://github.com/Gnimuc/Hungarian.jl
if compute:
    st_time = time()
    _assignment, _cost = jl.Main.hungarian(cost_m)
    # Julia is 1-indexed
    _assignment -= 1
    total_time = time() - st_time
    print('Julia computation used {:.3f} ms'.format(total_time * 1e3))
    
    st_time = time()
    assignment = ghpythonremote.obtain(_assignment.tolist())
    assignment = [int(v) for v in assignment]
    cost = _cost
    total_time = time() - st_time
    print('Getting results back to GH takes {} ms'.format(total_time*1e3))

if cost > penalty:
    raise RuntimeError('Infeasible matching: the matching includes undersized inventory elements!')
# ---------- end python_script_2 ----------
hungardian_jl_matching_cost = Panel(python_script_2.cost)
stream_filter_3 = StreamFilter(Gate=use_milp, Stream0=python_script_2.assignment, Stream1=integer_2)
julia_matching_cost = Panel(python_script_2.out)

# ---- group: A index -> B index
integer_3 = Integer(stream_filter_3)

# ----
integer_4 = Integer(integer_3)

# ---- group: inventory -> design
ghpython_script_3 = GhPythonScript(int_tree=integer_4)  # -> out, a; inputs int_tree: tree of Int32
# ---------- ghpython_script_3: Python ----------
import Rhino.Geometry.Plane as Plane
import Rhino.Geometry.Point3d as Point3d
import Rhino.Geometry.Vector3d as Vector3d
import Rhino.Geometry.Quaternion as Quat
import Grasshopper.DataTree as DataTree # Add, AddRange(list, GHPath(i, j))
import Grasshopper.Kernel.Data.GH_Path as GHPath
import System
from System.Collections.Generic import List

from ghpythonlib.treehelpers import list_to_tree, tree_to_list
import os
import json
##############################

data_from_branch = tree_to_list(int_tree, lambda x:x)
branch_from_data = DataTree[int]()
for i, data in enumerate(data_from_branch):
    for d in data:
        branch_from_data.Add(i, GHPath(d))
a = branch_from_data
# ---------- end ghpython_script_3 ----------

# ----
tree_statistics = TreeStatistics(Tree=ghpython_script_3.a)  # -> Paths, Length, Count
split_tree = SplitTree(Data=curve_10, Masks=flatten(tree_statistics.Paths))  # -> Positive, Negative
list_item_14 = ListItem(List=length_5, Index=ghpython_script_3.a, Wrap=True)
end_points_3 = EndPoints(Curve=split_tree.Positive)  # -> Start, End
number_23 = Number(list_item_14)
length_8 = Length(Curve=split_tree.Positive)
mass_addition = MassAddition(Input=number_23)  # -> Result, PartialResults
point_9 = Point(end_points_3.Start)
split_tree_2 = SplitTree(Data=geometry_2, Masks=flatten(tree_statistics.Paths))  # -> Positive, Negative
xy_plane_2 = XYPlane(Origin=point_9)
division_3 = Division(A=number_23, B=length_8)
subtraction = Subtraction(A=mass_addition.PartialResults, B=number_23)
scale_nu = ScaleNU(Geometry=split_tree_2.Positive, Plane=xy_plane_2, ScaleX=1, ScaleY=1, ScaleZ=division_3)  # -> Geometry, Transform
longest_list_2 = LongestList(ListListA=point_9, ListListB=number_23, PaddingMode=2)  # -> ListListA, ListListB
unit_z_6 = UnitZ(Factor=subtraction)

# ---- group: compute total matching cost
list_item_15 = ListItem(List=number_19, Index=c_script.matched_A2B_ids, Wrap=True)
mass_addition_2 = MassAddition(Input=flatten(list_item_15))  # -> Result, PartialResults

# ----
c_matching_cost = Panel(mass_addition_2.Result)
move_8 = Move(Geometry=scale_nu.Geometry, Motion=unit_z_6)  # -> Geometry, Transform
geometry_3 = Geometry(move_8.Geometry)
clean_tree = CleanTree(RemoveNulls=True, RemoveInvalid=True, RemoveEmpty=False, Tree=geometry_3)
integer_5 = Integer(ghpython_script_3.a)
list_length_4 = ListLength(List=clean_tree)
ghpython_script_4 = GhPythonScript(geos=move_8.Geometry, design_from_inventory=integer_5)  # -> out, geo_from_design, design_from_cutoff; inputs geos: tree of GeometryBase, design_from_inventory: tree
# ---------- ghpython_script_4: Python ----------
import Rhino.Geometry.Plane as Plane
import Rhino.Geometry.Point3d as Point3d
import Rhino.Geometry.Vector3d as Vector3d
import Rhino.Geometry.Quaternion as Quat
import Grasshopper.DataTree as DataTree # Add, AddRange(list, GHPath(i, j))
import Grasshopper.Kernel.Data.GH_Path as GHPath
import System
from System.Collections.Generic import List
import Rhino.Geometry.GeometryBase as GeometryBase

from ghpythonlib.treehelpers import list_to_tree, tree_to_list
import os
import json
##############################

# total_num_design = design_from_inventory.DataCount
geo_from_design = DataTree[GeometryBase]()
design_from_cutoff = DataTree[bool]()

for inv_path in geos.Paths:
    num_design = len(geos.Branch(inv_path))
    for d_id, geo in zip(design_from_inventory.Branch(inv_path), geos.Branch(inv_path)):
        geo_from_design.Add(geo, GHPath(d_id))
        design_from_cutoff.Add(num_design>1, GHPath(d_id))
# ---------- end ghpython_script_4 ----------
repeat_data = RepeatData(Data=S, Length=list_length_4)  # -> simplify(Data)
S_2 = Shader(repeat_data)
ghpython_script_5 = GhPythonScript(materials=S_2, design_from_inventory=integer_5)  # -> out, mat_from_design; inputs materials: tree, design_from_inventory: tree
# ---------- ghpython_script_5: Python ----------
import Rhino.Geometry.Plane as Plane
import Rhino.Geometry.Point3d as Point3d
import Rhino.Geometry.Vector3d as Vector3d
import Rhino.Geometry.Quaternion as Quat
import Grasshopper.DataTree as DataTree # Add, AddRange(list, GHPath(i, j))
import Grasshopper.Kernel.Data.GH_Path as GHPath
import System
from System.Collections.Generic import List
import Rhino.Geometry.GeometryBase as GeometryBase
import Rhino.Display.DisplayMaterial as DisplayMaterial
from Grasshopper.Kernel.Types import GH_Material

from ghpythonlib.treehelpers import list_to_tree, tree_to_list
import os
import json
##############################

# total_num_design = design_from_inventory.DataCount
mat_from_design = DataTree[GH_Material]()

for inv_path in materials.Paths:
    num_design = len(materials.Branch(inv_path))
    for d_id, geo in zip(design_from_inventory.Branch(inv_path), materials.Branch(inv_path)):
        mat_from_design.Add(GH_Material(geo), GHPath(d_id))
# ---------- end ghpython_script_5 ----------
custom_preview_4 = CustomPreview(Geometry=clean_tree, Material=repeat_data)
geometry_4 = Geometry(ghpython_script_4.geo_from_design)
volume_4 = Volume(Geometry=geometry_4)  # -> Volume, Centroid

# ---- group: visualize with matching lines
perp_frame = PerpFrame(Curve=reparameterize(curve_6), Parameter="0.5")
line_5 = Line(StartPoint=perp_frame, EndPoint=volume_4.Centroid)

# ----
xy_plane_3 = XYPlane(Origin=volume_4.Centroid)
boolean_5 = Boolean(ghpython_script_4.design_from_cutoff)
orient_2 = Orient(Geometry=geometry_4, Source=xy_plane_3, Target=perp_frame)  # -> Geometry, Transform
shader = Shader(ghpython_script_5.mat_from_design)

# ---- group: individual matching visualization
number_slider_4 = Slider(80, range=0..164)
tree_statistics_2 = TreeStatistics(Tree=orient_2.Geometry)  # -> Paths, Length, Count
list_item_16 = ListItem(List=flatten(boolean_5), Index=number_slider_4, Wrap=True)
list_item_17 = ListItem(List=tree_statistics_2.Paths, Index=number_slider_4, Wrap=True)
list_item_18 = ListItem(List=flatten(line_5), Index=number_slider_4, Wrap=True)
dash_pattern = DashPattern(Curve=list_item_18, Pattern=panel_27)  # -> simplify(Dashes), Gaps
tree_branch = TreeBranch(Tree=orient_2.Geometry, Path=list_item_17, MaintainPaths=True)
tree_branch_2 = TreeBranch(Tree=shader, Path=list_item_17, MaintainPaths=True)
stream_filter_4 = StreamFilter(Gate=list_item_16, Stream0=colour_swatch, Stream1=colour_swatch_2)
custom_preview_5 = CustomPreview(Geometry=dash_pattern.Dashes, Material=stream_filter_4)
custom_preview_6 = CustomPreview(Geometry=tree_branch, Material=tree_branch_2)

# ---- group: viz everything
dispatch = Dispatch(List=flatten(line_5), DispatchPattern=flatten(boolean_5))  # -> ListA, ListB
dash_pattern_2 = DashPattern(Curve=dispatch.ListA, Pattern=panel_27)  # -> simplify(Dashes), Gaps
dash_pattern_3 = DashPattern(Curve=dispatch.ListB, Pattern=panel_27)  # -> simplify(Dashes), Gaps
custom_preview_7 = CustomPreview(Geometry=dash_pattern_3.Dashes, Material=colour_swatch)
custom_preview_8 = CustomPreview(Geometry=orient_2.Geometry, Material=shader)
custom_preview_9 = CustomPreview(Geometry=dash_pattern_2.Dashes, Material=colour_swatch_2)
