# Grasshopper definition algorithmic_circular_dome.gh (Grasshopper 1.0.7)
# plug-ins: GhPolyhedra, Reader, Sift, SelectablePreview, Kangaroo2 Components, karambaGH

panel = Panel("""Grade of Wood

Low=1
Medium=2
High=3""")
brep = Brep(Tree({0}: [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], {1}: [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], {2}: [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], {3}: [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], {4}: [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], {5}: [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]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))
tree_statistics = TreeStatistics(Tree=brep)  # -> Paths, Length, Count
merge = Merge(
    Data1="3",
    Data2="3",
    Data3="3",
    Data4="2",
    Data5="2",
    Data6="3",
    Data7="3",
    Data8="3",
    Data9="2",
    Data10="1",
    Data11="1",
    Data12="2",
    Data13="1",
    Data14="3")
series = Series(Start=0, Step=1, Count=tree_statistics.Count)
gradient = Gradient(
    LowerLimit="0",
    UpperLimit=tree_statistics.Count,
    Parameter=series,
    stops=[0.0441: RGB(255, 228, 196), 0.0598: RGB(255, 224, 192), 0.178: RGB(210, 180, 140), 0.31: RGB(80, 55, 25), 0.408: RGB(128, 64, 0), 0.517: RGB(160, 82, 45), 0.599: RGB(159, 65, 29), 0.737: RGB(184, 134, 11), 0.961: RGB(174, 166, 129)])

use_inventory_subsets = BooleanToggle(False)
series_2 = Series(Start=0, Step=1, Count=Slider(10, range=0..10))  # -> graft(Series)

construct_path = ConstructPath(Indices=series_2)  # -> flatten(Branch)
split_tree = SplitTree(Data=brep, Masks=flatten(construct_path))  # -> Positive, Negative
integer = Integer(simplify(graft(merge)))
split_tree_2 = SplitTree(Data=integer, Masks=flatten(construct_path))  # -> Positive, Negative
colour = Colour(simplify(graft(gradient)))
split_tree_3 = SplitTree(Data=colour, Masks=flatten(construct_path))  # -> Positive, Negative
stream_filter = StreamFilter(Gate=use_inventory_subsets, Stream0=brep, Stream1=split_tree.Positive)
data = Data(stream_filter)
stream_filter_2 = StreamFilter(Gate=use_inventory_subsets, Stream0=integer, Stream1=split_tree_2.Positive)
stream_filter_3 = StreamFilter(Gate=use_inventory_subsets, Stream0=colour, Stream1=split_tree_3.Positive)
longest_list = LongestList(ListListA=stream_filter_2, ListListB=data, PaddingMode=2)  # -> ListListA, ListListB
longest_list_2 = LongestList(ListListA=stream_filter_3, ListListB=data, PaddingMode=2)  # -> ListListA, ListListB
integer_2 = Integer(flatten(longest_list.ListListA))
brep_2 = Brep(data)
colour_2 = Colour(longest_list_2.ListListA)

wire_type = Slider(2, range=0..2)
clean_wire = Button()
wirecleaner = WireCleaner(on=clean_wire, wire_type=wire_type)  # -> out, a
# ---------- wirecleaner: Python ----------
from Grasshopper.Kernel import GH_ParamWireDisplay
from Grasshopper.Kernel import GH_RuntimeMessageLevel 

# A dictionary of wire types 
wire_display = {'0':GH_ParamWireDisplay.default, 
                '1':GH_ParamWireDisplay.faint,
                '2':GH_ParamWireDisplay.hidden}

# Get selected components and change the wire display
if on:
    doc = ghenv.Component.OnPingDocument()
    sel_objs = doc.SelectedObjects()
    if not len(sel_objs):
        ghenv.Component.AddRuntimeMessage(GH_RuntimeMessageLevel.Warning, 'Nothing was selected')
    for sel_obj  in sel_objs:
        if hasattr(sel_obj, 'Params'):
            for p in sel_obj.Params.Input:
                if hasattr(p, 'WireDisplay'):
                    p.WireDisplay = wire_display[wire_type]
        else:
            if hasattr(sel_obj, 'WireDisplay'):
                sel_obj.WireDisplay = wire_display[wire_type]
# ---------- end wirecleaner ----------

number_of_domes = Slider(3, range=1..15)
point = Point(Point(0, 0, 0))
point_2 = Point(Point(1, 0, 0))
line = Line(StartPoint=point, EndPoint=point_2)

# ---- group: Subdivision parameterized curve
number_slider = Slider(0.1, range=0..1)
number_slider_2 = Slider(0.35, range=0..1)
number_slider_3 = Slider(0.08, range=0..1)
number_slider_4 = Slider(0.1, range=0..1)

# ---- group: Scaling parameterized curve
number_slider_5 = Slider(0.23, range=0..1)
number_slider_6 = Slider(0.55, range=0..1)
number_slider_7 = Slider(0.15, range=0..1)
number_slider_8 = Slider(0.04, range=0..1)

# ----
brep_3 = Brep(brep_2)
graft_tree = GraftTree(Tree=brep_3, IncludeEmptyLists=True, IncludeNullItems=True)
deconstruct_brep = DeconstructBrep(Brep=graft_tree)  # -> Faces, Edges, Vertices

# ---- group: Subdivision parameterized curve / Bounds of subdivision [integer]
construct_domain = ConstructDomain(DomainStart="1", DomainEnd="2")

# ---- group: Subdivision parameterized curve
merge_2 = Merge(Data1=number_slider_2, Data2=number_slider_3, Data3=number_slider_4, Data4=number_slider)
list_length = ListLength(List=merge_2)
addition = Addition(A=number_of_domes, B=1)
subtraction = Subtraction(A=list_length, B=1)
divide_curve = DivideCurve(Curve=line, Count=subtraction, Kinks=False)  # -> Points, Tangents, Parameters
construct_domain_2 = ConstructDomain(DomainStart="1", DomainEnd=number_of_domes)
unit_z = UnitZ(Factor=merge_2)
divide_curve_2 = DivideCurve(Curve=line, Count=addition, Kinks=False)  # -> Points, Tangents, Parameters
move = Move(Geometry=divide_curve.Points, Motion=unit_z)  # -> Geometry, Transform
sub_list = SubList(List=divide_curve_2.Points, Domain=construct_domain_2, Wrap=True)  # -> List, Index
sort_points = SortPoints(Points=move.Geometry)  # -> Points, Indices
subtraction_2 = Subtraction(A=list_length, B=1)
unit_z_2 = UnitZ(Factor=1)
nurbs_curve = NurbsCurve(Vertices=sort_points.Points, Degree=subtraction_2, Periodic=False)  # -> Curve, Length, Domain
project_point = ProjectPoint(Point=sub_list.List, Direction=unit_z_2, Geometry=nurbs_curve.Curve)  # -> Point, Index
deconstruct = Deconstruct(Point=project_point.Point)  # -> XComponent, YComponent, ZComponent
remap_numbers = RemapNumbers(Value=deconstruct.ZComponent, Source=Domain(0, 1), Target=construct_domain)  # -> Mapped, Clipped
round = Round(Number=remap_numbers.Mapped)  # -> Nearest, Floor, Ceiling

# ----
evaluate_surface = EvaluateSurface(Surface=reparameterize(deconstruct_brep.Faces), Point="0.5,0.5")  # -> Point, Normal, UDirection, VDirection, Frame

# ---- group: Scaling parameterized curve / Bounds of scale [m]
construct_domain_3 = ConstructDomain(DomainStart="1", DomainEnd="6")

# ---- group: Scaling parameterized curve
merge_3 = Merge(Data1=number_slider_5, Data2=number_slider_7, Data3=number_slider_8, Data4=number_slider_6)
list_length_2 = ListLength(List=merge_3)
subtraction_3 = Subtraction(A=list_length_2, B=1)
addition_2 = Addition(A=number_of_domes, B=1)
divide_curve_3 = DivideCurve(Curve=line, Count=subtraction_3, Kinks=False)  # -> Points, Tangents, Parameters
unit_z_3 = UnitZ(Factor=merge_3)
construct_domain_4 = ConstructDomain(DomainStart="1", DomainEnd=number_of_domes)
divide_curve_4 = DivideCurve(Curve=line, Count=addition_2, Kinks=False)  # -> Points, Tangents, Parameters
move_2 = Move(Geometry=divide_curve_3.Points, Motion=unit_z_3)  # -> Geometry, Transform
sub_list_2 = SubList(List=divide_curve_4.Points, Domain=construct_domain_4, Wrap=True)  # -> List, Index
sort_points_2 = SortPoints(Points=move_2.Geometry)  # -> Points, Indices
subtraction_4 = Subtraction(A=list_length_2, B=1)
unit_z_4 = UnitZ(Factor=1)
nurbs_curve_2 = NurbsCurve(Vertices=sort_points_2.Points, Degree=subtraction_4, Periodic=False)  # -> Curve, Length, Domain
project_point_2 = ProjectPoint(Point=sub_list_2.List, Direction=unit_z_4, Geometry=nurbs_curve_2.Curve)  # -> Point, Index
deconstruct_2 = Deconstruct(Point=project_point_2.Point)  # -> XComponent, YComponent, ZComponent
remap_numbers_2 = RemapNumbers(Value=deconstruct_2.ZComponent, Source=Domain(0, 1), Target=construct_domain_3)  # -> Mapped, Clipped

# ----
unit_z_5 = UnitZ(Factor=1)
dot_product = DotProduct(VectorA=unit_z_5, VectorB=evaluate_surface.Normal, Unitize=False)

# ---- group: Scaling parameterized curve / Scale values
number = Number(remap_numbers_2.Mapped)

# ---- group: Subdivision parameterized curve / Subdivision values
number_2 = Number(round.Nearest)

# ----
equality = Equality(FirstNumber=dot_product, SecondNumber="0")  # -> Equality, Inequality
cull_pattern = CullPattern(List=deconstruct_brep.Faces, CullPattern=equality.Inequality)
is_planar = IsPlanar(Surface=cull_pattern, Interior=True)  # -> Planar, Plane
area = Area(Geometry=cull_pattern)  # -> Area, Centroid
icosphere = IcoSphere(Plane=PlaneXY(0, 0, 0), Scale=number, Density=number_2)  # -> flatten(Mesh)

# ---- group: Array domes in a line
spacing_between_domes = Slider(2, range=0..10)
multiplication = Multiplication(A=number, B=spacing_between_domes)
gap = Panel("1")
addition_3 = Addition(A=multiplication, B=gap)
list_item = ListItem(List=addition_3, Index=0, Wrap=True)
mass_addition = MassAddition(Input=addition_3)  # -> Result, PartialResults
subtraction_5 = Subtraction(A=mass_addition.PartialResults, B=list_item)
unit_x = UnitX(Factor=subtraction_5)

# ----
list_item_2 = ListItem(List=is_planar.Plane, Index=0, Wrap=True)
bounding_box = BoundingBox(Content=graft_tree, Plane=list_item_2)  # -> Box, Box_2
volume = Volume(Geometry=bounding_box.Box)  # -> Volume, Centroid
sort_list = SortList(Keys=area.Area, ValuesValuesA=is_planar.Plane)  # -> Keys, ValuesValuesA
list_item_3 = ListItem(List=sort_list.ValuesValuesA, Index=0, Wrap=True)  # -> Item1, Item
bounding_box_2 = BoundingBox(Content=graft_tree, Plane=list_item_3.Item1)  # -> Box, Box_2
volume_2 = Volume(Geometry=bounding_box_2.Box)  # -> Volume, Centroid
smaller_than = SmallerThan(FirstNumber=volume.Volume, SecondNumber=volume_2.Volume)  # -> SmallerThan, OrEqualTo
pick_n_choose = PickNChoose(Pattern=smaller_than.SmallerThan, Stream0=bounding_box_2.Box, Stream1=bounding_box.Box)
deconstruct_box = DeconstructBox(Box=pick_n_choose)  # -> Plane, simplify(X), simplify(Y), simplify(Z)
merge_4 = Merge(Data1=deconstruct_box.X, Data2=deconstruct_box.Y, Data3=deconstruct_box.Z)
sort_list_2 = SortList(Keys=merge_4)  # -> Keys, ValuesValuesA
list_item_4 = ListItem(List=sort_list_2.Keys, Index=0, Wrap=True)  # -> Item, Item1, Item2
move_3 = Move(Geometry=icosphere, Motion=unit_x)  # -> Geometry, Transform
shift_paths = ShiftPaths(Data=list_item_4.Item, Offset=-1)
shift_paths_2 = ShiftPaths(Data=list_item_4.Item1, Offset=-1)
shift_paths_3 = ShiftPaths(Data=list_item_4.Item2, Offset=-1)
mesh = Mesh(simplify(graft(move_3.Geometry)))
sample_size_pick_one_every_n = Slider(2, range=1..5)
sort_list_3 = SortList(Keys=shift_paths_3, ValuesValuesA=shift_paths)  # -> Keys, ValuesValuesA
sort_list_4 = SortList(Keys=shift_paths_3, ValuesValuesA=shift_paths_2)  # -> Keys, ValuesValuesA

# ---- group: orient dome using a 5-valence vertex and normal / vertex 0 seems always to be 5-valence...
vertexneighbours = VertexNeighbours(Mesh=mesh, VertexNumber="0")  # -> Vertex, simplify(Neighbours), Normal

# ---- group: orient dome using a 5-valence vertex and normal
volume_3 = Volume(Geometry=mesh)  # -> Volume, Centroid
plane_normal = PlaneNormal(Origin=vertexneighbours.Vertex, ZAxis=vertexneighbours.Normal)
xy_plane = XYPlane(Origin=volume_3.Centroid)
orient = Orient(Geometry=mesh, Source=plane_normal, Target=xy_plane)  # -> Geometry, Transform

# ----
diplay_spacing_between_elements = Slider(1, range=0..2)

# ---- group: move to origin
volume_4 = Volume(Geometry=orient.Geometry)  # -> Volume, Centroid
vector_2pt = Vector2Pt(PointA=volume_4.Centroid, PointB=volume_3.Centroid, Unitize=False)  # -> Vector, Length
move_4 = Move(Geometry=orient.Geometry, Motion=vector_2pt.Vector)  # -> Geometry, Transform

# ----
gap_between_split_elements = Slider(0.3, range=0..1)
unit_y = UnitY(Factor=gap_between_split_elements)

# ---- group: number of domes
integer_3 = Integer(number_of_domes)

# ---- group: penalty
number_3 = Number("1e7")

# ---- group: Import remote python modules
ghpython_script = PythonScript()  # -> rhino_doc_dir
# ---------- ghpython_script: Python ----------
import scriptcontext as sc
from os import path

rhino_doc_dir = path.abspath(path.dirname(sc.doc.Path))
# ---------- end ghpython_script ----------
panel_2 = Panel(ghpython_script)
value_list = ValueList({"CRITICAL", "ERROR", "WARNING", "INFO", "DEBUG", "NOTSET"}, selected="DEBUG")
panel_3 = Panel("""numpy
julia""")
restart_python = BooleanToggle(True)
ghpythonremote = GHPythonRemote(location="conda://py27", run=restart_python, modules=panel_3, log_level=value_list, working_dir=panel_2)  # -> out, linked_modules, rpy; inputs run: Boolean, modules: list
# ---------- ghpythonremote: Python ----------
import sys
import scriptcontext
import logging
import inspect
import ghpythonremote
from ghpythonremote.connectors import GrasshopperToPythonRemote
from os import path
from time import sleep

local_log_level = getattr(logging, log_level, logging.WARNING)
logger = logging.getLogger('ghpythonremote')
logger.setLevel(local_log_level)
ch = logging.StreamHandler()
ch.setLevel(local_log_level)
formatter = logging.Formatter('%(levelname)s: %(name)s:\n%(message)s')
ch.setFormatter(formatter)
logger.handlers = []
logger.addHandler(ch)
logger = logging.getLogger('ghpythonremote.GH_to_python')

ROOT = path.abspath(path.dirname(inspect.getfile(ghpythonremote)))
rpyc_server_py = path.join(ROOT, 'pythonservice.py')

# Set connection to CLOSED if this is the first run
# and initialize set of linked modules
try:
    remote_python_status
except NameError:
    remote_python_status = 'CLOSED'
    lkd_modules = set()

# Wait for connection to connect or terminate
timer = 0
while remote_python_status == 'CONNECTING' or remote_python_status == 'CLOSING':
    sleep(1)
    timer += 1
    if timer == 10:
        try:
            gh2py_manager.__exit__(*sys.exc_info())
        except Exception:
            pass
        remote_python_status = 'CLOSED'
        lkd_modules = set()
        raise RuntimeError("Connection left in an inconsistent state and not returning. Reset everything.")

if run:
    if not remote_python_status == 'OPEN':
        remote_python_status = 'CONNECTING'
        gh2py_manager = GrasshopperToPythonRemote(rpyc_server_py, location=location, timeout=10,
                                                  port=None, log_level=log_level, working_dir=working_dir)
        gh2py = gh2py_manager.__enter__()
        remote_python_status = 'OPEN'

    # Stuff that we can reach
    rpymod = gh2py.py_remote_modules  # A getter function for a named python module
    rpy = gh2py.connection  # Represents the remote instance root object
    scriptcontext.sticky['rpy'] = rpy
    # Add modules
    for mod in modules:
        try:
            scriptcontext.sticky[mod] = rpymod(mod)
            lkd_modules.add(mod)
        except ImportError:
            gh2py_manager.__exit__(*sys.exc_info())
            raise

elif not remote_python_status == 'CLOSED':
    remote_python_status = 'CLOSING'
    # Remove linked modules
    for mod in lkd_modules:
        del scriptcontext.sticky[mod]
    del scriptcontext.sticky['rpy']
    gh2py_manager.__exit__(*sys.exc_info())
    lkd_modules = set()
    remote_python_status = 'CLOSED'

# Change variable name because ghpython resets outputs to None before each run
linked_modules = lkd_modules

logger.info('GH to python connection is {}'.format(remote_python_status))
# ---------- end ghpythonremote ----------
ghpython_script_2 = PythonScript(module_names=ghpythonremote.linked_modules)  # -> import_statements; inputs module_names: list
# ---------- ghpython_script_2: Python ----------
import_statements = ["import scriptcontext as sc"]
for module_name in module_names:
    import_statements.append("{0} = sc.sticky['{0}']".format(module_name))

if len(module_names) == 0:
    import_statements = []
# ---------- end ghpython_script_2 ----------
panel_4 = Panel(ghpython_script_2)
panel_5 = Panel(ghpythonremote.out)

# ----
use_julia_backend = BooleanToggle(False)

# ---- group: toggle matching line viz here!
viz_matching_line = BooleanToggle(False)

# ----
# Design Space Exploration
panel_6 = Panel("feasible_MOO_match-coverage_data.csv")
panel_7 = Panel("feasible_match-floor_data.csv")
rhino_doc_dir = RhinoDocDir()  # -> rhino_doc_dir; same code as ghpython_script
text = Text(panel_6)
concatenate = Concatenate(Fragment_A=rhino_doc_dir, A="/data/", Fragment_B=text)
reader = Reader(Filepath=concatenate, Separator=",")
number_slider_9 = Slider(100, range=10..100)
addition_4 = Addition(A=number_slider_9, B="10")
addition_5 = Addition(A=number_slider_9, B="10")
unit_x_2 = UnitX(Factor=addition_4)
unit_y_2 = UnitY(Factor=addition_5)
number_slider_10 = Slider(0.5, range=0..1)
text_2 = Text(text)
panel_8 = Panel(text_2)
match_text = MatchText(Text=text_2, RegEx="floor", Case=True)
unit_x_3 = UnitX(Factor=1)
stream_filter_4 = StreamFilter(Gate=match_text, Stream0="material coverage", Stream1="total floor area")
panel_9 = Panel(match_text)
unit_y_3 = UnitY(Factor=1)
negative = Negative(Value=unit_x_3)
number_slider_11 = Slider(1.5, range=0..10)
point_3 = Point("2.0,0,0")
point_4 = Point("0,2.0,0")

# ----
# get rid of column names
panel_10 = Panel("{0}")
split_tree_4 = SplitTree(Data=reader, Masks=flatten(panel_10))  # -> Positive, Negative

split_list = SplitList(List=split_tree_4.Negative, Index="9")  # -> simplify(ListA), simplify(ListB)
list_item_5 = ListItem(List=split_list.ListB, Index=0, Wrap=True)  # -> Item, Item1
negative_2 = Negative(Value=list_item_5.Item1)
panel_11 = Panel(split_tree_4.Positive)
cluster = Cluster_3(number=list_item_5.Item, domain_end=number_slider_9)
cluster_2 = Cluster_3(number=negative_2, domain_end=number_slider_9)
construct_point = ConstructPoint(XCoordinate=cluster, YCoordinate=cluster_2, ZCoordinate=0)
number_4 = Number(split_list.ListA)

# ---- group: origin
unit_y_4 = UnitY(Factor=Slider(10, range=10..30))

# ---- group: cross section chopping
cluster_3 = Cluster_2(list=sort_list_4.Keys, size=sample_size_pick_one_every_n)
cluster_4 = Cluster_2(list=sort_list_3.ValuesValuesA, size=sample_size_pick_one_every_n)
cluster_5 = Cluster_2(list=sort_list_4.ValuesValuesA, size=sample_size_pick_one_every_n)
domain_box = DomainBox(Base=PlaneXY(0, 0, 0), X=cluster_4, Y=cluster_4, Z=cluster_3)  # -> simplify(graft(Box))

# ---- group: cross section chopping / y/x
division = Division(A=cluster_5, B=cluster_4)  # -> simplify(graft(Result))

# ---- group: cross section chopping (continued)
round_2 = Round(Number=division)  # -> Nearest, Floor, Ceiling

# ----
tree_statistics_2 = TreeStatistics(Tree=domain_box)  # -> Paths, Length, Count
series_3 = Series(Start=0, Step=diplay_spacing_between_elements, Count=tree_statistics_2.Count)
unit_x_4 = UnitX(Factor=graft(series_3))
match_tree = MatchTree(Tree=unit_x_4, Guide=domain_box)

# ---- group: middle x coordinate of inventory
integer_4 = Integer(series_3)
list_length_3 = ListLength(List=integer_4)
multiplication_2 = Multiplication(A=list_length_3, B=Slider(0.333, range=0..1))
integer_5 = Integer(multiplication_2)
list_item_6 = ListItem(List=integer_4, Index=integer_5, Wrap=True)

# ----
move_5 = Move(Geometry=domain_box, Motion=match_tree)  # -> Geometry, Transform
linear_array = LinearArray(Geometry=move_5.Geometry, Direction=unit_y, Count=round_2.Floor)  # -> Geometry, Transform
deconstruct_box_2 = DeconstructBox(Box=linear_array.Geometry)  # -> Plane, X, Y, Z

# ----
# Geodesic Dome
number_slider_12 = Slider(25.44, range=0..100)
number_5 = Number(list_item_6)
construct_point_2 = ConstructPoint(XCoordinate=number_5, YCoordinate=number_slider_12, ZCoordinate=0)
move_6 = Move(Geometry=move_4.Geometry, Motion=construct_point_2)  # -> Geometry, Transform
face_boundaries = FaceBoundaries(Mesh=move_6.Geometry)
boundary_surfaces = BoundarySurfaces(Edges=face_boundaries)
brep_join = BrepJoin(Breps=boundary_surfaces)  # -> Breps, Closed
box = Box(brep_join.Breps)
deconstruct_brep_2 = DeconstructBrep(Brep=box)  # -> Faces, Edges, Vertices
list_item_7 = ListItem(List=reverse(deconstruct_brep_2.Edges), Index=0, Wrap=True)
list_item_8 = ListItem(List=reverse(deconstruct_brep_2.Faces), Index=0, Wrap=True)
length = Length(Curve=list_item_7)
division_2 = Division(A=length, B=2)
unit_z_6 = UnitZ(Factor=division_2)
negative_3 = Negative(Value=unit_z_6)
move_7 = Move(Geometry=list_item_8, Motion=negative_3)  # -> Geometry, Transform
split_brep = SplitBrep(Brep=brep_join.Breps, Cutter=move_7.Geometry)
list_item_9 = ListItem(List=split_brep, Index=0, Wrap=True)
mesh_brep = MeshBrep(
    Brep=list_item_9,
    Settings={GridMaxCount=0, GridMinCount=16, JaggedSeams=False, MaxEdgeLength=0, MinEdgeLength=0.0001, MinTolerance=0, Refine=True, RefineAngle=0, RelativeTolerance=0.65, SimplePlanes=True, Tolerance=0})
mesh_edges = MeshEdges(Mesh=mesh_brep)  # -> NakedEdges, InteriorEdges, NonManifoldEdges
unit_x_5 = UnitX(Factor=Slider(10, range=0..10))
curve = Curve([mesh_edges.InteriorEdges, mesh_edges.NakedEdges])
linear_array_2 = LinearArray(Geometry=curve, Direction=unit_x_5, Count=Slider(1, range=0..10))  # -> Geometry, Transform

# ---- group: origin (continued)
point_5 = Point(construct_point_2)
move_8 = Move(Geometry=point_5, Motion=unit_y_4)  # -> Geometry, Transform

# ----
longest_list_3 = LongestList(ListListA=move_8.Geometry, ListListB=construct_point, PaddingMode=2)  # -> ListListA, ListListB
match_tree_2 = MatchTree(Tree=longest_list_3.ListListA, Guide=construct_point)
dot_display = DotDisplay(Point=move_8.Geometry, Colour=ColourSwatch(SwatchColor=RGB(0, 0, 0)), Size=number_slider_10)
addition_6 = Addition(A=match_tree_2, B=construct_point)
move_9 = Move(Geometry=move_8.Geometry, Motion=unit_y_2)  # -> Geometry, Transform
move_10 = Move(Geometry=move_8.Geometry, Motion=unit_x_2)  # -> Geometry, Transform
dot_display_2 = DotDisplay(Point=addition_6, Colour=ColourSwatch(SwatchColor=RGB(15, 131, 255)), Size=number_slider_10)
selectablepreview = SelectablePreview(Geometry=addition_6, lock=False, maintain=False, order=False, selectedobject="505")  # -> Geometry, Path, Index
list_item_10 = ListItem(List=selectablepreview.Path, Index=0, Wrap=True)  # -> Item1, Item
deconstruct_path = DeconstructPath(Branch=list_item_10.Item1)
subtraction_6 = Subtraction(A=deconstruct_path, B=1)
sift = Sift(
    Variables=[number_slider_5, number_slider_7, number_slider_8, number_slider_6, number_slider_2, number_slider_3, number_slider_4, number_slider, number_of_domes],
    DesignMap=number_4,
    Index=subtraction_6)
panel_12 = Panel(sift)
line_2 = Line(StartPoint=move_8.Geometry, EndPoint=move_9.Geometry)
line_3 = Line(StartPoint=move_8.Geometry, EndPoint=move_10.Geometry)
tree_branch = TreeBranch(Tree=split_list.ListB, Path=list_item_10.Item1, MaintainPaths=True)
tree_branch_2 = TreeBranch(Tree=number_4, Path=list_item_10.Item1, MaintainPaths=True)
panel_13 = Panel(tree_branch_2)
panel_14 = Panel(list_item_10.Item1)
panel_15 = Panel(tree_branch)
curve_middle = CurveMiddle(Curve=line_2)
curve_middle_2 = CurveMiddle(Curve=line_3)
subtraction_7 = Subtraction(A=curve_middle, B=point_3)
construct_plane = ConstructPlane(Origin=subtraction_7, XAxis=unit_y_3, YAxis=negative)
subtraction_8 = Subtraction(A=curve_middle_2, B=point_4)
text_tag_3d = TextTag3D(Location=subtraction_8, Text="matching score", Size=number_slider_11, Justification=7)
text_tag_3d_2 = TextTag3D(Location=construct_plane, Text=stream_filter_4, Size=number_slider_11, Justification=7)

unit_z_7 = UnitZ(Factor=deconstruct_box_2.Z)
number_6 = Number(flatten(deconstruct_box_2.X))
number_7 = Number(flatten(deconstruct_box_2.Y))
number_8 = Number(flatten(deconstruct_box_2.Z))
division_3 = Division(A=unit_z_7, B="2")
negative_4 = Negative(Value=division_3)
volume_5 = Volume(Geometry=linear_array.Geometry)  # -> Volume, Centroid

# ---- group: cross section y
number_9 = Number(number_7)

# ---- group: cross section x
number_10 = Number(number_6)

# ----
move_11 = Move(Geometry=volume_5.Centroid, Motion=division_3)  # -> Geometry, Transform
move_12 = Move(Geometry=volume_5.Centroid, Motion=negative_4)  # -> Geometry, Transform
line_4 = Line(StartPoint=move_12.Geometry, EndPoint=move_11.Geometry)  # -> flatten(Line)

# ---- group: floor area
deconstruct_box_3 = DeconstructBox(Box=box)  # -> Plane, X, Y, Z
cluster_6 = Cluster(domain=deconstruct_box_3.X)
cluster_7 = Cluster(domain=deconstruct_box_3.Y)
division_4 = Division(A=cluster_6, B=2)
division_5 = Division(A=cluster_7, B=2)
minimum = Minimum(A=division_4, B=division_5)
power = Power(A=minimum, B="2")
pi = Pi(Factor=power)  # -> flatten(Output)

# ---- group: design curves
curve_2 = Curve(flatten(linear_array_2.Geometry))

# ----
list_length_4 = ListLength(List=curve_2)
list_length_5 = ListLength(List=line_4)
concatenate_2 = Concatenate(FragmentA="#design: ", FragmentB=list_length_4)
concatenate_3 = Concatenate(FragmentA="#inventory: ", FragmentB=list_length_5)
panel_16 = Panel(concatenate_3)
panel_17 = Panel(concatenate_2)

# ---- group: FEA
curve_3 = Curve(curve_2)
end_points = EndPoints(Curve=curve_3)  # -> Start, End
remove_duplicate_points_karamba3d = RemoveDuplicatePointsKaramba3D(Point=[end_points.Start, end_points.End], LimitDistance=0.005)  # -> OutPoint, Info, Indexes
deconstruct_3 = Deconstruct(Point=remove_duplicate_points_karamba3d.OutPoint)  # -> XComponent, YComponent, ZComponent
sort_list_5 = SortList(Keys=deconstruct_3.ZComponent)  # -> Keys, ValuesValuesA
mesh_2 = Mesh(mesh_brep)
list_item_11 = ListItem(List=sort_list_5.Keys, Index=0, Wrap=True)
number_11 = Number("0.00001")
face_boundaries_2 = FaceBoundaries(Mesh=mesh_2)
expression = Expression(zmin=list_item_11, z=deconstruct_3.ZComponent, tol=number_11, Expression="if(abs(zmin-z)<tol,true,false)")
boundary_surfaces_2 = BoundarySurfaces(Edges=flatten(face_boundaries_2))
mesh_breps_karamba3d = MeshBrepsKaramba3D(
    Brep=boundary_surfaces_2,
    MeshResolution=Slider(100, range=0..100),
    EdgeRefinementFactor=0.67,
    PointReduction=False,
    SmoothingStepSize=0,
    SmoothingIterations=5)  # -> Mesh, Info
cull_pattern_2 = CullPattern(List=remove_duplicate_points_karamba3d.OutPoint, CullPattern=expression)
panel_18 = Panel("5")
unit_z_8 = UnitZ(Factor=Slider(4, range=1..5))  # -> expr("-x", UnitVector)
material_selection_karamba3d = MaterialSelectionKaramba3D(menu=[dropdown(4), dropdown(1)])
cross_section_karamba3d = CrossSectionKaramba3D(
    FamilyNameOfCrossSection="DefaultCroSec",
    Material=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,
    Height_cm="5",
    UpperFlangeWidth_cm="5",
    LowerFlangeWidth_cm="5",
    mode="Trapezoid")
support_karamba3d = SupportKaramba3D(PosInd=cull_pattern_2, menu=[buttons(on, on, on, off, off, off)])
line_to_beam_karamba3d = LineToBeamKaramba3D(Line=curve_3, New=True, Remove=True, LimitDistance_m=0.005, Bending=Toggle(False))  # -> Element, Points, Info
loads_karamba3d = LoadsKaramba3D(
    Vector=unit_z_8,
    Mesh=mesh_breps_karamba3d.Mesh,
    LCase=0,
    mode="MeshLoad -Const.",
    menu=[buttons(off, on, off), buttons(off, on)])
assemble_model_karamba3d = AssembleModelKaramba3D(
    Elem=line_to_beam_karamba3d.Element,
    Support=support_karamba3d,
    Load=loads_karamba3d,
    CrossSection=cross_section_karamba3d,
    Material=material_selection_karamba3d,
    LimitDistance_m=0.005)  # -> Model, Info, Mass_kg, CenterOfGravity
analyze_karamba3d = AnalyzeKaramba3D(Model=assemble_model_karamba3d.Model)  # -> CalculatedModel, MaximumDisplacement_cm, ResultingForceOfGravity_kN, ElasticEnergy_kNm
disassemble_material_karamba3d = DisassembleMaterialKaramba3D(Material=material_selection_karamba3d)  # -> Material, TypeOfMaterial, FamilyNameOfMaterial, NameOfMaterial, ElemIdentifiers, Color, YoungsModulusKNCm2Dir12, InPlaneShearModulus_kN_cm2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
model_view_karamba3d = ModelViewKaramba3D(Model=analyze_karamba3d.CalculatedModel, ResultFactors=1, ResultCase=-1)  # -> Model, DeformedMesh, DeformedAxes, DeformedModel; disabled
beam_forces_karamba3d = BeamForcesKaramba3D(
    AnalyzedModel=analyze_karamba3d.CalculatedModel,
    LCase=-1,
    MaximumDistanceBetweenResults_m=-1,
    NumberOfResultsPerBeamElement=2)  # -> AnalyzedModel, NormalForce_kN, ShearForceVz_kN, ShearForceVy_kN, BendingMomentMt_kNm, BendingMomentMy_kNm, BendingMomentMz_kNm
beam_view_karamba3d = BeamViewKaramba3D(Model=model_view_karamba3d.Model)  # -> Model, MeshesOfRenderedBeams, DeformedBeamAxes, LegendColors, LegendTags; disabled
list_item_12 = ListItem(List=beam_forces_karamba3d.NormalForce_kN, Index=0, Wrap=True)  # -> flatten(Item)
legend = Legend(Colour=beam_view_karamba3d.LegendColors, Tags=beam_view_karamba3d.LegendTags, LegendType=1)  # disabled

# ---- group: inventory curves
curve_4 = Curve(line_4)

# ---- group: design curves
curve_5 = Curve(curve_2)

# ---- group: domes floor area
number_12 = Number(pi)
panel_19 = Panel(number_12)

# ---- group: Lengths in design
length_2 = Length(Curve=curve_5)

# ---- group: Lengths in inventory
length_3 = Length(Curve=curve_4)

# ----
target_load_demand_kn = Number(list_item_12)
mass_addition_2 = MassAddition(Input=number_12)  # -> Result, PartialResults

# ---- group: total floor area
number_13 = Number(flatten(mass_addition_2.Result))
panel_20 = Panel(number_13)

# ---- group: Allowable stress [kN/cm^2], assumed 0.5*yield stress
number_14 = Number(disassemble_material_karamba3d.YieldStrengthKNCm2Dir12)
multiplication_3 = Multiplication(A=number_14, B="0.5")

# ---- group: Elastic modulus [kN/cm^2]
number_15 = Number(disassemble_material_karamba3d.YoungsModulusKNCm2Dir12)

# ----
# inventory cross section x
# inventory cross section y
number_16 = Number(number_9)
number_17 = Number(number_10)

# ----
# Julia Matching backend
panel_21 = Panel("\jl_scripts\hungarian_upcycling.jl")
rhino_doc_dir_2 = RhinoDocDir()  # -> rhino_doc_dir; same code as ghpython_script
concatenate_4 = Concatenate(FragmentA=rhino_doc_dir_2, FragmentB=panel_21)
compute_matching = BooleanToggle(False)
reload = Button()
ghpython_script_3 = GhPythonScript(x=concatenate_4)  # -> a
# ---------- ghpython_script_3: Python ----------
import os
a = os.path.abspath(x)
assert os.path.exists(a)
# ---------- end ghpython_script_3 ----------
ghpython_script_4 = GhPythonScript(
    compute=compute_matching,
    reload=reload,
    jl_script_path=ghpython_script_3,
    demand_lengths=length_2,
    supply_lengths=length_3,
    demand_loads=target_load_demand_kn,
    supply_cross_sec_xs=number_17,
    supply_cross_sec_ys=number_16,
    allowable_stress=multiplication_3,
    elastic_modulus=number_15,
    penalty=number_3)  # -> out, assignment, cost, material_coverage; inputs demand_lengths: list, supply_lengths: list, demand_loads: list, supply_cross_sec_xs: list, supply_cross_sec_ys: list
# ---------- ghpython_script_4: Python ----------
import Grasshopper.DataTree as DataTree # Add, AddRange(list, GHPath(i, j))
import Grasshopper.Kernel.Data.GH_Path as GHPath
import System
from System.Collections.Generic import List

from ghpythonlib.treehelpers import list_to_tree, tree_to_list

import math
import scriptcontext as sc
import ghpythonremote
from time import time
np = sc.sticky['numpy']
rpy = sc.sticky['rpy']
jl = sc.sticky['julia']

##############################

#st_time = time()
np_demand_lengths = ghpythonremote.deliver(rpy, demand_lengths)
np_supply_lengths = ghpythonremote.deliver(rpy, supply_lengths)
np_demand_loads = ghpythonremote.deliver(rpy, demand_loads)
np_supply_cross_sec_xs = ghpythonremote.deliver(rpy, supply_cross_sec_xs)
np_supply_cross_sec_ys = ghpythonremote.deliver(rpy, supply_cross_sec_ys)
#total_time = time() - st_time
#print('numpy data ghpyremote sending takes {} ms'.format(total_time*1e3))

#st_time = time()
try:
    jl.Main.eval('println("Julia env inititated.")')
except:
    jl.Julia()

try:
    jl.Main.eval('using Main:hungarian_upcycling_assignment')
    if reload:
        raise RuntimeError()
except:
    jl.Main.include(jl_script_path)
#total_time = time() - st_time
#print('Julia setup takes {} ms'.format(total_time*1e3))

if compute:
    st_time = time()

    _assignment, _cost_opt, _material_cov = \
        jl.Main.hungarian_upcycling_assignment(np_demand_lengths, np_supply_lengths, np_demand_loads, 
            np_supply_cross_sec_xs, np_supply_cross_sec_ys, 
            allowable_stress, elastic_modulus, penalty)
    if _assignment is not None:
        assert np.all(_assignment>0), 'Assignment has zero indices (which should all >= 1).'
        print('Cost {}'.format(_cost_opt))
        # Julia is 1-indexed
        _assignment -= 1
        total_time = time() - st_time
        print('Julia computation used {:.1f} mins'.format(total_time/60))
        print('~ {:.1f} secs'.format(total_time))
        if _cost_opt >= penalty:
            assignment = None
            material_coverage = 0.0
        else:
            assignment_list = ghpythonremote.obtain(_assignment.tolist())
            assignment = [int(v) for v in assignment_list]
            material_coverage = float(_material_cov)
        cost = _cost_opt
    else:
        print("Inventory not large enough.")
        assignment = None
        cost = penalty*len(demand_loads)
        material_coverage = 0.0
# ---------- end ghpython_script_4 ----------
number_18 = Number(ghpython_script_4.cost)
number_19 = Number(ghpython_script_4.material_coverage)
integer_6 = Integer(ghpython_script_4.assignment)
panel_22 = Panel(ghpython_script_4.out)
panel_23 = Panel(number_18)

# ---- group: inventory color / inventory geometries
geometry = Geometry(flatten(linear_array.Geometry))

# ---- group: inventory color / design curves
curve_6 = Curve(curve_5)

# ---- group: inventory color / inventory curves
curve_7 = Curve(curve_4)

# ---- group: inventory color / design
curve_8 = Curve(curve_6)

# ---- group: inventory color / inventory
curve_9 = Curve(curve_7)

# ----
# C# Matching backend
ghpython_script_5 = GhPythonScript(
    demand_lengths=length_2,
    supply_lengths=length_3,
    demand_loads=target_load_demand_kn,
    supply_cross_sec_xs=number_17,
    supply_cross_sec_ys=number_16,
    allowable_stress=multiplication_3,
    elastic_modulus=number_15,
    penalty=number_3)  # -> out, cost_matrix; inputs demand_lengths: list, supply_lengths: list, demand_loads: list, supply_cross_sec_xs: list, supply_cross_sec_ys: list
# ---------- ghpython_script_5: Python ----------
import Grasshopper.DataTree as DataTree # Add, AddRange(list, GHPath(i, j))
import Grasshopper.Kernel.Data.GH_Path as GHPath
import System
from System.Collections.Generic import List
import math

from ghpythonlib.treehelpers import list_to_tree, tree_to_list
##############################

def compute_moment_of_inertia(b,h):
    # input: b,h in meter
    # return: I in cm^4
    return (b*pow(h,3)/12)*1e8

def compute_strength_capacity(b,h,Fy):
    # input: b,h in meter;
    #        Fy in kN/cm^2: allowable stress
    # return: Fmax in kN
    return b*h*1e4*Fy

def compute_buckling_capacity(b,h,L,E):
    # input: b,h,L in meter, E in kN/cm^2
    # return: buckling capacity R in kN
    I = compute_moment_of_inertia(b,h)
    return (1.0/3)*pow(math.pi,2)*E*I/pow(L,2)*1e-4
    
######################################

demand_num = len(demand_lengths)
supply_num = len(supply_lengths)
assert demand_num <= supply_num, 'demand_num ({}) > supply_num ({})'.format(demand_num, supply_num)
assert len(demand_loads) == demand_num
assert len(supply_cross_sec_xs) == supply_num
assert len(supply_cross_sec_ys) == supply_num

cost_matrix = [[0.0 for _ in range(supply_num)] for _ in range(demand_num)]

for i in range(demand_num):
    for j in range(supply_num):
        Li = demand_lengths[i]
        Lj = supply_lengths[j]
        if Li > Lj:
            # length constraint violated
            cost_matrix[i][j] = penalty
        else:
            demand_load = demand_loads[i]
            b = max(supply_cross_sec_xs[j], supply_cross_sec_ys[j])
            h = min(supply_cross_sec_xs[j], supply_cross_sec_ys[j])
            tensile_capacity = compute_strength_capacity(b,h,allowable_stress)
            capacity = 0.0
            if demand_load >= 0:
                # tensile demand
                capacity = tensile_capacity
            else:
                # compressive demand
                L = min(Li,Lj) # in meter
                buckling_capacity = compute_buckling_capacity(b,h,L,elastic_modulus)
                compressive_capacity = min(buckling_capacity, tensile_capacity)
                capacity = min(tensile_capacity, compressive_capacity)
            if abs(demand_load) > capacity:
                # capacity constraint violated
                cost_matrix[i][j] = penalty
            else:
                # euclidean distance
                cost_matrix[i][j] = math.sqrt(pow(Li-Lj,2)+\
                                    pow(abs(capacity)-abs(demand_load),2))

cost_matrix = list_to_tree(cost_matrix, source=[])
# ---------- end ghpython_script_5 ----------
number_20 = Number(number_3)
number_21 = Number(ghpython_script_5.cost_matrix)

# ---- group: using external dll
c_script = CSharpScript(
    distance_matrix=number_21,
    integral_scale="1e2",
    penalty=number_20,
    Reference="C:\USERS\HARRY\DROPBOX (MIT)\PROJECTS\CIRCULARECONOMY\CDOS_2021\SCRIPTS\YJ\HungarianAlgorithm.dll")  # -> out, matched_A2B_ids, cost_star; inputs distance_matrix: tree of Double, integral_scale: Double, penalty: Double
# ---------- c_script: C# usings ----------
using System.IO;
using System.Linq;
using System.Data;
using System.Drawing;
using System.Reflection;
using System.Windows.Forms;
using System.Xml;
using System.Xml.Linq;
using System.Runtime.InteropServices;

using Rhino.DocObjects;
using Rhino.Collections;
using GH_IO;
using GH_IO.Serialization;

using HungarianAlgorithm;
using HungarianAlgorithm.Extensions;
# ---------- c_script: C# ----------
    // dimension of the input lists
    int n = distance_matrix.BranchCount;
    int m = distance_matrix.Branch(0).Count;

    if(0 == m * n)
    {
      this.Component.AddRuntimeMessage(Grasshopper.Kernel.GH_RuntimeMessageLevel.Error, "intput tree data branch dimension = 0!");
      return;
    }

    if(n > m)
    {
      this.Component.AddRuntimeMessage(Grasshopper.Kernel.GH_RuntimeMessageLevel.Error,
        "Branch count must be smaller than the size of each branch! (design pt number should be smaller than inventory pts!)");
      return;
    }
    // The algorithm doesn't always produce the most optimal result, when the input contains more columns (m) than rows (n).
    // To overcome this issue, square the dimensions of the input before passing it to the algorithm.

    //    var watch = new System.Diagnostics.Stopwatch();
    //    if(timing)
    //    {
    //      watch.Start();
    //    }

    // generate the cost matrix
    int[,] costs = new int[m, m];

    for(int i = 0; i < m; i++)
    {
      for(int j = 0; j < m; j++)
      {
        if(i >= n)
        {
          // fill the matrix to be square
          costs[i, j] = (int) Int32.MaxValue;
        }
        else
        {
          // the algorithm only takes integral inputs, scale it up here.
          double scaled_cost = distance_matrix.Branch(i)[j] * integral_scale;
          if(scaled_cost > Int32.MaxValue) {
            throw new OverflowException(
              //            this.Component.AddRuntimeMessage(Grasshopper.Kernel.GH_RuntimeMessageLevel.Error,
              String.Format("Cost at ({0},{1}): {2} bigger than maximal integral value {3}", i, j, scaled_cost, Int32.MaxValue));
          }
          costs[i, j] = (int) scaled_cost;
//          if (costs[i, j] < 1e-6)
//          {
//            Print(String.Format("{0}",costs[i, j]));
//          }
        }
      }
    }

    int[,] costs_copy = (int[,]) costs.Clone();
    double final_cost = 0;
    
    int[] matched_pts2_ids = HungarianAlgorithm.HungarianAlgorithm.FindAssignments(costs);

    DataTree<int> matched_A2B = new DataTree<int>();
    for(int i = 0; i < n; i++)
    {
      var pth = new GH_Path(i);
      final_cost += (double) costs_copy[i, matched_pts2_ids[i]] / integral_scale;
      matched_A2B.Add(matched_pts2_ids[i], pth);
    }

    if(final_cost > penalty)
    {
      this.Component.AddRuntimeMessage(Grasshopper.Kernel.GH_RuntimeMessageLevel.Error,
        "Computed assignment cost > penalty terms!");
      throw new Exception("Infeasible matching.");
    }

    //    if(timing)
    //    {
    //      watch.Stop();
    //      Print(String.Format("Execution Time: {0} ms", watch.ElapsedMilliseconds));
    //    }

    matched_A2B_ids = matched_A2B;
    cost_star = final_cost;
# ---------- end c_script ----------

# ----
integer_7 = Integer(flatten(c_script.matched_A2B_ids))
number_22 = Number(c_script.cost_star)
panel_24 = Panel(number_22)

stream_filter_5 = StreamFilter(Gate=use_julia_backend, Stream0=number_22, Stream1=number_18)

# ---- group: matching score
number_23 = Number(flatten(stream_filter_5))
panel_25 = Panel(number_23)

# ----
division_6 = Division(A=number_23, B=number_13)

# ---- group: objective printouts
number_24 = Number(number_23)
larger_than = LargerThan(FirstNumber=number_24, SecondNumber=number_3)  # -> LargerThan, OrEqualTo
number_25 = Number(number_19)
number_26 = Number(number_13)
format = Format(Format="{0:0.00}", Culture=127, Data0=number_24)
number_27 = Number(division_6)
number_28 = Number(number_25)
format_2 = Format(Format="{0:0.00}", Culture=127, Data0=number_27)
format_3 = Format(Format="{0:0.00}", Culture=127, Data0=number_28)
format_4 = Format(Format="{0:0.00}", Culture=127, Data0=number_26)
stream_filter_6 = StreamFilter(Gate=larger_than.OrEqualTo, Stream0=format, Stream1="infeasible")
integer_8 = Integer(number_of_domes)
concatenate_5 = Concatenate(FragmentA="# of domes: ", FragmentB=integer_8)
concatenate_6 = Concatenate(FragmentA="objective: ", FragmentB=format_2)
concatenate_7 = Concatenate(FragmentA="material coverage: ", FragmentB=format_3)
concatenate_8 = Concatenate(FragmentA="floor area: ", FragmentB=format_4)
concatenate_9 = Concatenate(FragmentA="matching score: ", FragmentB=stream_filter_6)
construct_point_3 = ConstructPoint(XCoordinate=number_5, YCoordinate=Slider(17.78, range=0..100), ZCoordinate=0)
text_3 = Text(concatenate_3)
text_4 = Text(concatenate_2)
xy_plane_2 = XYPlane(Origin=construct_point_3)
concatenate_10 = Concatenate(
    Fragment_A=text_3,
    F=concatenate_5,
    Fragment_B=text_4,
    B=concatenate_9,
    E=concatenate_8,
    I=concatenate_7,
    K=concatenate_6)
text_tag_3d_3 = TextTag3D(Location=xy_plane_2, Text=concatenate_10, Size=Slider(1.3, range=0.5..5), Justification=7)

# ----
stream_filter_7 = StreamFilter(Gate=use_julia_backend, Stream0=integer_7, Stream1=integer_6)
integer_9 = Integer(simplify(graft(stream_filter_7)))

# ---- group: inventory color / A index -> B index
integer_10 = Integer(integer_9)

# ---- group: inventory color
# design lines
# Inventory Display
colour_3 = Colour(colour_2)
brep_4 = Brep(linear_array.Geometry)
geometry_2 = Geometry(simplify(graft(geometry)))
integer_11 = Integer(integer_10)
colour_swatch = ColourSwatch(SwatchColor=RGBA(255, 255, 255, 32))
length_4 = Length(Curve=curve_8)
curve_10 = Curve(simplify(graft(curve_9)))
S = Shader([{diffuse=RGB(11, 125, 222), emission=RGB(3, 38, 67), shine=0.5, specular=RGB(255, 255, 255), transparency=0}, {diffuse=RGB(222, 37, 11), emission=RGB(67, 11, 3), shine=0.5, specular=RGB(255, 255, 255), transparency=0}, {diffuse=RGB(71, 222, 11), emission=RGB(21, 67, 3), shine=0.5, specular=RGB(255, 255, 255), transparency=0}, {diffuse=RGB(222, 194, 11), emission=RGB(67, 58, 3), shine=0.5, specular=RGB(255, 255, 255), transparency=0}])
curve_11 = Curve(simplify(graft(curve_6)))
perp_frame = PerpFrame(Curve=reparameterize(curve_11), Parameter="0.5")
point_6 = Point(perp_frame)
panel_26 = Panel(""".5
.1""")
colour_swatch_2 = ColourSwatch(SwatchColor=RGB(12, 203, 142))
stream_gate = StreamGate(Stream=point_6, Gate=viz_matching_line)  # -> Target0, Target1
colour_swatch_3 = ColourSwatch(SwatchColor=RGB(90, 169, 172))
panel_27 = Panel("""5.0
1.0""")
unit_z_9 = UnitZ(Factor=Slider(11.8, range=0..20))
xy_plane_3 = XYPlane(Origin=Point(0, 0, 0))
move_13 = Move(Geometry=xy_plane_3, Motion=unit_z_9)  # -> Geometry, Transform

# ----
cluster_8 = Cluster_2(list=colour_3, size=sample_size_pick_one_every_n)

# ---- group: inventory color / inventory colors
colour_4 = Colour(flatten(cluster_8))

# ----
graft_tree_2 = GraftTree(Tree=colour_4, IncludeEmptyLists=True, IncludeNullItems=True)  # -> simplify(Tree)

# ---- group: inventory color / inventory -> design
ghpython_script_6 = GhPythonScript(int_tree=integer_11)  # -> out, a; inputs int_tree: tree of Int32
# ---------- ghpython_script_6: Python ----------
import Rhino.Geometry.Plane as Plane
import Rhino.Geometry.Point3d as Point3d
import Rhino.Geometry.Vector3d as Vector3d
import Rhino.Geometry.Quaternion as Quat
import Grasshopper.DataTree as DataTree # Add, AddRange(list, GHPath(i, j))
import Grasshopper.Kernel.Data.GH_Path as GHPath
import System
from System.Collections.Generic import List

from ghpythonlib.treehelpers import list_to_tree, tree_to_list
import os
import json
##############################

data_from_branch = tree_to_list(int_tree, lambda x:x)
branch_from_data = DataTree[int]()
for i, data in enumerate(data_from_branch):
    for d in data:
        branch_from_data.Add(i, GHPath(d))
a = branch_from_data
# ---------- end ghpython_script_6 ----------

# ---- group: inventory color (continued)
create_material = CreateMaterial(Diffuse=cluster_8, Specular=RGB(255, 255, 255), Emission=RGB(0, 0, 0), Transparency=Slider(0.9, range=0..1), Shine=0)
tree_statistics_3 = TreeStatistics(Tree=ghpython_script_6.a)  # -> Paths, Length, Count
split_tree_5 = SplitTree(Data=graft_tree_2, Masks=flatten(tree_statistics_3.Paths))  # -> Positive, Negative
split_tree_6 = SplitTree(Data=curve_10, Masks=flatten(tree_statistics_3.Paths))  # -> Positive, Negative
list_item_13 = ListItem(List=length_4, Index=ghpython_script_6.a, Wrap=True)
custom_preview = CustomPreview(Geometry=brep_4, Material=create_material)
end_points_2 = EndPoints(Curve=split_tree_6.Positive)  # -> Start, End
number_29 = Number(list_item_13)
length_5 = Length(Curve=split_tree_6.Positive)
point_7 = Point(end_points_2.Start)
split_tree_7 = SplitTree(Data=geometry_2, Masks=flatten(tree_statistics_3.Paths))  # -> Positive, Negative
mass_addition_3 = MassAddition(Input=number_29)  # -> Result, PartialResults
xy_plane_4 = XYPlane(Origin=point_7)
division_7 = Division(A=number_29, B=length_5)
subtraction_9 = Subtraction(A=mass_addition_3.PartialResults, B=number_29)
scale_nu = ScaleNU(Geometry=split_tree_7.Positive, Plane=xy_plane_4, ScaleX=1, ScaleY=1, ScaleZ=division_7)  # -> Geometry, Transform
unit_z_10 = UnitZ(Factor=subtraction_9)
move_14 = Move(Geometry=scale_nu.Geometry, Motion=unit_z_10)  # -> Geometry, Transform
geometry_3 = Geometry(move_14.Geometry)
clean_tree = CleanTree(RemoveNulls=True, RemoveInvalid=True, RemoveEmpty=False, Tree=geometry_3)
integer_12 = Integer(ghpython_script_6.a)
list_length_6 = ListLength(List=clean_tree)
colour_5 = Colour(split_tree_5.Positive)
S_2 = Shader(colour_5)
ghpython_script_7 = GhPythonScript(geos=move_14.Geometry, design_from_inventory=integer_12)  # -> out, geo_from_design, design_from_cutoff; inputs geos: tree of GeometryBase, design_from_inventory: tree
# ---------- ghpython_script_7: Python ----------
import Rhino.Geometry.Plane as Plane
import Rhino.Geometry.Point3d as Point3d
import Rhino.Geometry.Vector3d as Vector3d
import Rhino.Geometry.Quaternion as Quat
import Grasshopper.DataTree as DataTree # Add, AddRange(list, GHPath(i, j))
import Grasshopper.Kernel.Data.GH_Path as GHPath
import System
from System.Collections.Generic import List
import Rhino.Geometry.GeometryBase as GeometryBase

from ghpythonlib.treehelpers import list_to_tree, tree_to_list
import os
import json
##############################

# total_num_design = design_from_inventory.DataCount
geo_from_design = DataTree[GeometryBase]()
design_from_cutoff = DataTree[bool]()

for inv_path in geos.Paths:
    num_design = len(geos.Branch(inv_path))
    for d_id, geo in zip(design_from_inventory.Branch(inv_path), geos.Branch(inv_path)):
        geo_from_design.Add(geo, GHPath(d_id))
        design_from_cutoff.Add(num_design>1, GHPath(d_id))
# ---------- end ghpython_script_7 ----------
ghpython_script_8 = GhPythonScript(materials=S_2, design_from_inventory=integer_12)  # -> out, mat_from_design; inputs materials: tree, design_from_inventory: tree
# ---------- ghpython_script_8: Python ----------
import Rhino.Geometry.Plane as Plane
import Rhino.Geometry.Point3d as Point3d
import Rhino.Geometry.Vector3d as Vector3d
import Rhino.Geometry.Quaternion as Quat
import Grasshopper.DataTree as DataTree # Add, AddRange(list, GHPath(i, j))
import Grasshopper.Kernel.Data.GH_Path as GHPath
import System
from System.Collections.Generic import List
import Rhino.Geometry.GeometryBase as GeometryBase
import Rhino.Display.DisplayMaterial as DisplayMaterial
from Grasshopper.Kernel.Types import GH_Material

from ghpythonlib.treehelpers import list_to_tree, tree_to_list
import os
import json
##############################

# total_num_design = design_from_inventory.DataCount
mat_from_design = DataTree[GH_Material]()

for inv_path in materials.Paths:
    num_design = len(materials.Branch(inv_path))
    for d_id, geo in zip(design_from_inventory.Branch(inv_path), materials.Branch(inv_path)):
        mat_from_design.Add(GH_Material(geo), GHPath(d_id))
# ---------- end ghpython_script_8 ----------
repeat_data = RepeatData(Data=S, Length=list_length_6)  # -> simplify(Data)
custom_preview_2 = CustomPreview(Geometry=clean_tree, Material=colour_5)
geometry_4 = Geometry(ghpython_script_7.geo_from_design)
volume_6 = Volume(Geometry=geometry_4)  # -> Volume, Centroid
xy_plane_5 = XYPlane(Origin=volume_6.Centroid)
orient_2 = Orient(Geometry=geometry_4, Source=xy_plane_5, Target=perp_frame)  # -> Geometry, Transform
shader = Shader(ghpython_script_8.mat_from_design)
boolean = Boolean(ghpython_script_7.design_from_cutoff)
stream_gate_2 = StreamGate(Stream=volume_6.Centroid, Gate=viz_matching_line)  # -> Target0, Target1
line_5 = Line(StartPoint=stream_gate.Target1, EndPoint=volume_6.Centroid)
project = Project(Geometry=stream_gate_2.Target0, Plane=move_13.Geometry)  # -> Geometry, Transform
dot_display_3 = DotDisplay(Point=flatten(project.Geometry), Colour=colour_swatch_2, Size=Slider(0.3, range=0..1))

# ----
number_slider_13 = Slider(80, range=0..164)  # disabled
tree_statistics_4 = TreeStatistics(Tree=orient_2.Geometry)  # -> Paths, Length, Count; disabled
list_item_14 = ListItem(List=flatten(boolean), Index=number_slider_13, Wrap=True)  # disabled
list_item_15 = ListItem(List=tree_statistics_4.Paths, Index=number_slider_13, Wrap=True)  # disabled
list_item_16 = ListItem(List=flatten(line_5), Index=number_slider_13, Wrap=True)  # disabled
dash_pattern = DashPattern(Curve=list_item_16, Pattern=panel_26)  # -> simplify(Dashes), Gaps; disabled
tree_branch_3 = TreeBranch(Tree=orient_2.Geometry, Path=list_item_15, MaintainPaths=True)  # disabled
tree_branch_4 = TreeBranch(Tree=shader, Path=list_item_15, MaintainPaths=True)  # disabled
stream_filter_8 = StreamFilter(Gate=list_item_14, Stream0=colour_swatch_2, Stream1=colour_swatch_3)  # disabled
custom_preview_3 = CustomPreview(Geometry=dash_pattern.Dashes, Material=stream_filter_8)  # disabled
custom_preview_4 = CustomPreview(Geometry=tree_branch_3, Material=tree_branch_4)  # disabled

# ---- group: inventory color / viz matching lines
dispatch = Dispatch(List=flatten(line_5), DispatchPattern=flatten(boolean))  # -> ListA, ListB
dash_pattern_2 = DashPattern(Curve=dispatch.ListA, Pattern=panel_26)  # -> simplify(Dashes), Gaps
dash_pattern_3 = DashPattern(Curve=dispatch.ListB, Pattern=panel_26)  # -> simplify(Dashes), Gaps
custom_preview_5 = CustomPreview(Geometry=dash_pattern_3.Dashes, Material=colour_swatch_2)
custom_preview_6 = CustomPreview(Geometry=orient_2.Geometry, Material=shader)
custom_preview_7 = CustomPreview(Geometry=dash_pattern_2.Dashes, Material=colour_swatch_3)

# ==== cluster Cluster
domain = ClusterInput()
deconstruct_domain = DeconstructDomain(Domain=domain)  # -> Start, End
subtraction = Subtraction(A=deconstruct_domain.End, B=deconstruct_domain.Start)
result = ClusterOutput(subtraction)

# ==== cluster Cluster_2
list = ClusterInput()
size = ClusterInput()
partition_list = PartitionList(List=list, Size=size)
list_item = ListItem(List=partition_list, Index=0, Wrap=True)
shift_paths = ShiftPaths(Data=list_item, Offset=-1)
data = ClusterOutput(shift_paths)

# ==== cluster Cluster_3
number = ClusterInput()
number_2 = Number(number)
sort_list = SortList(Keys=flatten(number_2))  # -> Keys, ValuesValuesA
list_item = ListItem(List=sort_list.Keys, Index=0, Wrap=True)  # -> Item1, Item
domain_end = ClusterInput()
construct_domain = ConstructDomain(DomainStart=list_item.Item, DomainEnd=list_item.Item1)
construct_domain_2 = ConstructDomain(DomainStart="0", DomainEnd=domain_end)
remap_numbers = RemapNumbers(Value=number_2, Source=construct_domain, Target=construct_domain_2)  # -> Mapped, Clipped
mapped = ClusterOutput(remap_numbers.Mapped)
