# Grasshopper definition lp_assignment.gh (Grasshopper 1.0.7)

number_slider = Slider(6, range=6..10)

series = Series(Start=number_slider, Step="-1", Count=number_slider)  # -> simplify(graft(Series))

panel = Panel("6")
point = Point("0,0,0")
linear_array = LinearArray(Geometry=point, Direction=Vector(10, 0, 0), Count=number_slider)  # -> simplify(graft(Geometry)), Transform
unit_y = UnitY(Factor=Slider(2.6, range=1..10))
linear_array_2 = LinearArray(Geometry=linear_array.Geometry, Direction=unit_y, Count=series)  # -> Geometry, Transform
geometry = Geometry(<curve referenced from the Rhino model>)
geometry_2 = Geometry(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)
clean_tree = CleanTree(RemoveNulls=True, RemoveInvalid=True, RemoveEmpty=True, Tree=linear_array_2.Geometry)  # -> simplify(Tree)
populate_2d = Populate2D(Region=geometry, Count=number_slider, Seed=Slider(0, range=0..100))
panel_2 = Panel("\jl_scripts\hungarian_upcycling.jl")
rhino_doc_dir = RhinoDocDir()  # -> rhino_doc_dir
# ---------- rhino_doc_dir: Python ----------
import scriptcontext as sc
from os import path

rhino_doc_dir = path.abspath(path.dirname(sc.doc.Path))
# ---------- end rhino_doc_dir ----------
concatenate = Concatenate(FragmentA=rhino_doc_dir, FragmentB="\jl_scripts\lp_assignment.jl")

# ---- group: cost matrix
point_2 = Point(flatten(clean_tree))
point_3 = Point(populate_2d)
cross_reference = CrossReference(ListListA=graft(point_3), ListListB=point_2, CrossMode=1)  # -> simplify(ListListA), simplify(ListListB)
distance = Distance(PointA=cross_reference.ListListA, PointB=cross_reference.ListListB)

# ---- group: category generation
item_index = ItemIndex(List=point_2, Item=clean_tree)  # -> simplify(Index)
tree_branch = TreeBranch(Tree=item_index, Path=Slider(0, range=0..5), MaintainPaths=True)
list_item = ListItem(List=point_2, Index=tree_branch, Wrap=True)

# ----
compute_matching = BooleanToggle(True)
restart_python = BooleanToggle(True)

# ---- group: Import remote python modules
ghpython_script = PythonScript()  # -> rhino_doc_dir; same code as rhino_doc_dir
panel_3 = Panel(ghpython_script)
value_list = ValueList({"CRITICAL", "ERROR", "WARNING", "INFO", "DEBUG", "NOTSET"}, selected="DEBUG")
panel_4 = Panel("""numpy
julia""")
ghpythonremote = GHPythonRemote(location="conda://py27", run=restart_python, modules=panel_4, log_level=value_list, working_dir=panel_3)  # -> out, linked_modules, rpy; inputs run: Boolean, modules: list
# ---------- ghpythonremote: Python ----------
import sys
import scriptcontext
import logging
import inspect
import ghpythonremote
from ghpythonremote.connectors import GrasshopperToPythonRemote
from os import path
from time import sleep

local_log_level = getattr(logging, log_level, logging.WARNING)
logger = logging.getLogger('ghpythonremote')
logger.setLevel(local_log_level)
ch = logging.StreamHandler()
ch.setLevel(local_log_level)
formatter = logging.Formatter('%(levelname)s: %(name)s:\n%(message)s')
ch.setFormatter(formatter)
logger.handlers = []
logger.addHandler(ch)
logger = logging.getLogger('ghpythonremote.GH_to_python')

ROOT = path.abspath(path.dirname(inspect.getfile(ghpythonremote)))
rpyc_server_py = path.join(ROOT, 'pythonservice.py')

# Set connection to CLOSED if this is the first run
# and initialize set of linked modules
try:
    remote_python_status
except NameError:
    remote_python_status = 'CLOSED'
    lkd_modules = set()

# Wait for connection to connect or terminate
timer = 0
while remote_python_status == 'CONNECTING' or remote_python_status == 'CLOSING':
    sleep(1)
    timer += 1
    if timer == 10:
        try:
            gh2py_manager.__exit__(*sys.exc_info())
        except Exception:
            pass
        remote_python_status = 'CLOSED'
        lkd_modules = set()
        raise RuntimeError("Connection left in an inconsistent state and not returning. Reset everything.")

if run:
    if not remote_python_status == 'OPEN':
        remote_python_status = 'CONNECTING'
        gh2py_manager = GrasshopperToPythonRemote(rpyc_server_py, location=location, timeout=10,
                                                  port=None, log_level=log_level, working_dir=working_dir)
        gh2py = gh2py_manager.__enter__()
        remote_python_status = 'OPEN'

    # Stuff that we can reach
    rpymod = gh2py.py_remote_modules  # A getter function for a named python module
    rpy = gh2py.connection  # Represents the remote instance root object
    scriptcontext.sticky['rpy'] = rpy
    # Add modules
    for mod in modules:
        try:
            scriptcontext.sticky[mod] = rpymod(mod)
            lkd_modules.add(mod)
        except ImportError:
            gh2py_manager.__exit__(*sys.exc_info())
            raise

elif not remote_python_status == 'CLOSED':
    remote_python_status = 'CLOSING'
    # Remove linked modules
    for mod in lkd_modules:
        del scriptcontext.sticky[mod]
    del scriptcontext.sticky['rpy']
    gh2py_manager.__exit__(*sys.exc_info())
    lkd_modules = set()
    remote_python_status = 'CLOSED'

# Change variable name because ghpython resets outputs to None before each run
linked_modules = lkd_modules

logger.info('GH to python connection is {}'.format(remote_python_status))
# ---------- end ghpythonremote ----------
ghpython_script_2 = PythonScript(module_names=ghpythonremote.linked_modules)  # -> import_statements; inputs module_names: list
# ---------- ghpython_script_2: Python ----------
import_statements = ["import scriptcontext as sc"]
for module_name in module_names:
    import_statements.append("{0} = sc.sticky['{0}']".format(module_name))

if len(module_names) == 0:
    import_statements = []
# ---------- end ghpython_script_2 ----------
panel_5 = Panel(ghpython_script_2)
panel_6 = Panel(ghpythonremote.out)

# ----
reload = Button()
ghpython_script_3 = GhPythonScript(x=concatenate)  # -> a
# ---------- ghpython_script_3: Python ----------
import os
a = os.path.abspath(x)
assert os.path.exists(a)
# ---------- end ghpython_script_3 ----------
custom_preview = CustomPreview(
    Geometry=point_3,
    Material={diffuse=RGB(221, 160, 221), emission=RGB(66, 48, 66), shine=0.5, specular=RGB(255, 255, 255), transparency=0})
integer = Integer(item_index)
custom_preview_2 = CustomPreview(Geometry=point_2, Material=ColourSwatch(SwatchColor=RGB(0, 255, 255)))
number = Number(distance)
ghpython_script_4 = GhPythonScript(compute=compute_matching, reload=reload, jl_script_path=ghpython_script_3, cost_matrix=number, category=integer)  # -> out, assignment, cost; inputs cost_matrix: tree, category: tree of Int32
# ---------- ghpython_script_4: Python ----------
import Grasshopper.DataTree as DataTree # Add, AddRange(list, GHPath(i, j))
import Grasshopper.Kernel.Data.GH_Path as GHPath
import System
from System.Collections.Generic import List

from ghpythonlib.treehelpers import list_to_tree, tree_to_list

import math
import scriptcontext as sc
import ghpythonremote
from time import time
np = sc.sticky['numpy']
rpy = sc.sticky['rpy']
jl = sc.sticky['julia']

##############################

st_time = time()
_cost_matrix = tree_to_list(cost_matrix, lambda x:x)
_category = tree_to_list(category, lambda x:x)
np_cost_matrix = ghpythonremote.deliver(rpy, _cost_matrix)

print _category
if _category:
    # convert to Julia's one-based indexing
    for i, v in enumerate(_category):
        _category[i] = [e+1 for e in v]

total_time = time() - st_time
print('numpy data ghpyremote sending takes {} ms'.format(total_time*1e3))

st_time = time()
try:
    jl.Main.eval('println("Julia env inititated.")')
except:
    jl.Julia()

try:
    jl.Main.eval('using Main:solve_lp_assignment_problem')
    if reload:
        raise RuntimeError()
except:
    jl.Main.include(jl_script_path)
total_time = time() - st_time
print('Julia setup takes {} ms'.format(total_time*1e3))

if compute:
    st_time = time()

    _assignment, _cost_opt, _ = \
        jl.Main.solve_lp_assignment_problem(np_cost_matrix, binary_var=False, category=_category)
        
    if _assignment is not None:
        assert np.all(_assignment>0), 'Assignment has zero indices (which should all >= 1).'
        print('Cost {}'.format(_cost_opt))
        # Julia is 1-indexed
        _assignment -= 1
        total_time = time() - st_time
        print('Julia computation used {:.1f} mins'.format(total_time/60))
        print('~ {:.1f} secs'.format(total_time))
#        if _cost_opt >= penalty:
#            assignment = None
#        else:
        assignment_list = ghpythonremote.obtain(_assignment.tolist())
        assignment = [int(v) for v in assignment_list]
        cost = _cost_opt
    else:
        print("Inventory not large enough.")
        assignment = None
#        cost = penalty*len(demand_loads)
#        material_coverage = 0.0
# ---------- end ghpython_script_4 ----------
list_item_2 = ListItem(List=point_2, Index=ghpython_script_4.assignment, Wrap=True)
panel_7 = Panel(item_index)
panel_8 = Panel([ghpython_script_4.out, ghpython_script_4.assignment, ghpython_script_4.cost])
vector_2pt = Vector2Pt(PointA=point_3, PointB=list_item_2, Unitize=False)  # -> Vector, Length
vector_display = VectorDisplay(Anchor=point_3, Vector=vector_2pt.Vector)
